# Grasshopper definition daylighting_Macedonia.gh (Grasshopper 1.0.7)
# plug-ins: treesloth01, Pufferfish

# ----
# results from room generator gh file
input_data_moreobjectives_lessheight = Number(Tree({0;0;0}: [4, 17, 82, -41, 39, 41, 23, 73, 2, 116, 67, 106, 0.84, 0.5, 0.03, 0.27, 0.7, 0.8, 0.6, 0.8, 8, 7, 2, 10, 3, 2, 2, 2], {0;1;0}: [4, 41, 41, -36, 27, 69, 69, 3, 7, 16, 128, 144, 1.5, 2.78, 2.23, 1.47, 0.8, 0.4, 0.5, 0.1, 7, 6, 6, 10, 1, 3, 2, 0], {0;2;0}: [8, 17, 41, 42, 60, 44, 9, 6, 26, 12, 80, 83, 2.88, 0.27, 2.36, 2.43, 0.1, 0.6, 0.5, 0.7, 9, 3, 6, 3, 3, 4, 4, 4], {0;3;0}: [6, 90, 80, -29, 42, 31, 66, 33, 139, 8, 39, 95, 0.53, 2.72, 1.17, 2.43, 0.7, 0.2, 0.3, 0.8, 4, 4, 0, 2, 4, 0, 3, 5], {0;4;0}: [5, 47, 54, -21, 31, 75, 88, 89, 114, 100, 117, 31, 0.48, 1.5, 2.16, 1.04, 0.7, 0.3, 0.6, 0.8, 5, 7, 9, 5, 2, 4, 3, 4], {0;5;0}: [7, 44, 63, -27, 30, 48, 89, 6, 38, 36, 136, 79, 2.72, 1.08, 2.86, 1.66, 0, 0.1, 0.7, 0.8, 9, 10, 1, 7, 3, 1, 5, 3]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))
input_data_moreobjectives2 = Number(Tree({0;0;0}: [8, 95, 42, -22, 69, 12, 11, 71, 161, 125, 472, 142, 1.96, 1.4, 1.93, 2.11, 0.2, 0.3, 0.7, 0.7, 0, 4, 6, 8, 5, 1, 0, 2], {0;1;0}: [8, 32, 99, 3, 69, 89, 86, 68, 137, 412, 403, 218, 1.16, 1.67, 0.19, 1.42, 0.6, 0.1, 0.4, 0.3, 5, 2, 7, 7, 5, 3, 2, 0], {0;2;0}: [7, 46, 21, -17, 80, 9, 10, 43, 499, 475, 108, 51, 0.66, 2.92, 0.94, 2.87, 0.3, 0.4, 0.1, 0.4, 5, 1, 2, 5, 4, 5, 4, 0], {0;3;0}: [7, 60, 87, -24, 31, 39, 10, 48, 437, 181, 387, 64, 0.37, 1.11, 0.08, 1.11, 0.4, 0.2, 0.7, 0.2, 9, 2, 4, 0, 2, 0, 2, 4], {0;4;0}: [10, 53, 87, -30, 14, 85, 94, 9, 11, 70, 350, 147, 0.22, 2.99, 1.62, 2.78, 0.6, 0, 0.8, 0.8, 7, 1, 2, 3, 0, 5, 4, 3], {0;5;0}: [4, 26, 67, -24, 19, 21, 4, 36, 311, 160, 120, 342, 1.76, 2.23, 1.7, 1.6, 0.7, 0.3, 0.6, 0.3, 2, 1, 3, 2, 3, 4, 5, 3]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))
input_data_moreobjectives1 = Number(Tree({0;0;0}: [8, 95, 42, -22, 69, 12, 11, 71, 161, 125, 472, 142, 1.96, 1.4, 1.93, 2.11, 0.2, 0.3, 0.7, 0.7, 0, 4, 6, 8, 5, 1, 0, 2], {0;1;0}: [8, 32, 99, 3, 69, 89, 86, 68, 137, 412, 403, 218, 1.16, 1.67, 0.19, 1.42, 0.6, 0.1, 0.4, 0.3, 5, 2, 7, 7, 5, 3, 2, 0], {0;2;0}: [7, 46, 21, -17, 80, 9, 10, 43, 499, 475, 108, 51, 0.66, 2.92, 0.94, 2.87, 0.3, 0.4, 0.1, 0.4, 5, 1, 2, 5, 4, 5, 4, 0], {0;3;0}: [7, 60, 87, -24, 31, 39, 10, 48, 437, 181, 387, 64, 0.37, 1.11, 0.08, 1.11, 0.4, 0.2, 0.7, 0.2, 9, 2, 4, 0, 2, 0, 2, 4], {0;4;0}: [10, 53, 87, -30, 14, 85, 94, 9, 11, 70, 350, 147, 0.22, 2.99, 1.62, 2.78, 0.6, 0, 0.8, 0.8, 7, 1, 2, 3, 0, 5, 4, 3], {0;5;0}: [4, 26, 67, -24, 19, 21, 4, 36, 311, 160, 120, 342, 1.76, 2.23, 1.7, 1.6, 0.7, 0.3, 0.6, 0.3, 2, 1, 3, 2, 3, 4, 5, 3]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))

# ----
# Run animation
panel = Panel("animate")
c_script = CSharpScript(reset=Button(), run=Button(), SliderNames=panel)  # -> out, A; inputs reset: Boolean, run: Boolean, SliderNames: list of String, Runs: Int32
# ---------- c_script: C# usings ----------
using Grasshopper.Kernel.Special;
using Grasshopper.Kernel.Parameters;
# ---------- c_script: C# ----------
    if (!run)
    {
      gH_Document = Component.OnPingDocument();
      _SliderNames = SliderNames;
      _sliders = FindSlidersByName();

    }

    if (run)
      GrasshopperDocument.ScheduleSolution(10, ScheduleCallback);

    if (reset) resetSliders(_sliders);
# ---------- c_script: C# additional code ----------
  private GH_NumberSlider[] _sliders;
  GH_Document gH_Document;
  List<string> _SliderNames;

  private void ScheduleCallback(GH_Document document)
  {
    foreach (var slider in _sliders){
      decimal max = slider.Slider.Maximum;
      decimal current = slider.Slider.Value;
      decimal places = slider.Slider.DecimalPlaces;
      decimal iterator = (decimal) (1 / (Math.Pow(10, (int) places)));

      for (decimal k = current; k <= max; k += iterator)
        slider.TrySetSliderValue((decimal) k);
    }

  }

  private void resetSliders(GH_NumberSlider[] _sliders){

    foreach (var slider in _sliders){
      slider.TrySetSliderValue((decimal) 0);

    }
  }


  private GH_NumberSlider[] FindSlidersByName()
  {

    var sliders = new List<GH_NumberSlider>();

    foreach(var NickName in _SliderNames)
      foreach (var obj in gH_Document.Objects)
      {
        if(obj.NickName == NickName){
          var slider = obj as GH_NumberSlider;
          if (slider != null)
            sliders.Add(slider);
        }

      }
    return sliders.ToArray();
  }


  private GH_NumberSlider[] FindSliders()
  {

    var sliders = new List<GH_NumberSlider>();

    foreach (var obj in gH_Document.Objects)
    {
      if(_SliderNames.Contains(obj.NickName)){
        var slider = obj as GH_NumberSlider;
        if (slider != null)
          sliders.Add(slider);
      }

    }
    return sliders.ToArray();
  }
# ---------- end c_script ----------
panel_2 = Panel(c_script.A)

animate = Slider(260, range=260..999)
renumber = RenumberPaths(Data=input_data_moreobjectives_lessheight)
branch = TreeBranch(Tree=renumber, Path=animate, MaintainPaths=True)
item = ListItem(List=branch, Index="1", Wrap=True)
item_2 = ListItem(List=branch, Index="0", Wrap=True)
item_3 = ListItem(List=branch, Index="2", Wrap=True)
item_4 = ListItem(List=branch, Index="3", Wrap=True)
item_5 = ListItem(List=branch, Index="4", Wrap=True)
item_6 = ListItem(List=branch, Index="5", Wrap=True)
item_7 = ListItem(List=branch, Index="6", Wrap=True)
item_8 = ListItem(List=branch, Index="7", Wrap=True)
item_9 = ListItem(List=branch, Index="8", Wrap=True)
item_10 = ListItem(List=branch, Index="9", Wrap=True)
item_11 = ListItem(List=branch, Index="10", Wrap=True)
item_12 = ListItem(List=branch, Index="11", Wrap=True)
item_13 = ListItem(List=branch, Index="12", Wrap=True)
item_14 = ListItem(List=branch, Index="13", Wrap=True)
item_15 = ListItem(List=branch, Index="14", Wrap=True)
item_16 = ListItem(List=branch, Index="15", Wrap=True)
item_17 = ListItem(List=branch, Index="16", Wrap=True)
item_18 = ListItem(List=branch, Index="17", Wrap=True)
item_19 = ListItem(List=branch, Index="18", Wrap=True)
item_20 = ListItem(List=branch, Index="19", Wrap=True)
item_21 = ListItem(List=branch, Index="20", Wrap=True)
item_22 = ListItem(List=branch, Index="21", Wrap=True)
item_23 = ListItem(List=branch, Index="22", Wrap=True)
item_24 = ListItem(List=branch, Index="23", Wrap=True)
item_25 = ListItem(List=branch, Index="24", Wrap=True)
item_26 = ListItem(List=branch, Index="25", Wrap=True)
item_27 = ListItem(List=branch, Index="26", Wrap=True)
item_28 = ListItem(List=branch, Index="27", Wrap=True)

# ---- group: writer / compile dataset
panel_3 = Panel("C:\Users\agioia\OneDrive - Harley Ellis Devereaux\zz_Documents\zz_MaCAD\0.Thesis\roomDaylightData.csv")  # disabled

# ----
# 1a. create building mass
wlc_floorheight = Slider(4, range=3..10)
wlc_length = Slider(62, range=1..100)
wlc_width = Slider(70, range=1..100)
rectangle = Rectangle(Plane=PlaneXY(0, 0, 0), XSize=item, YSize=item_3, Radius=0)  # -> Rectangle, Length
wlc_rotation = Slider(-44, range=-44..45)
area = Area(Geometry=rectangle.Rectangle)  # -> Area, Centroid
pt = ConstructPoint(XCoordinate=0, YCoordinate=0, ZCoordinate=0)
move2pt = MoveToPoint(Geometry=rectangle.Rectangle, PointA=area.Centroid, PointB=pt)  # -> Moved, Vector, Transform
boxrec = BoxRectangle(Rectangle=move2pt.Moved, Height=item_2)
rotate = Rotate(Geometry=boxrec, Angle=degrees(item_4), Plane=PlaneXY(0, 0, 0))  # -> Geometry, Transform

ladybug = Ladybug_Ladybug()  # -> Vviiiiiiiiiizzz; plug-in component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
honeybee = Honeybee_Honeybee()  # -> Vviiiiiiiiiizzz; plug-in component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

# ----
# 2. create shading context masses
wlc_southcontextoffset = Slider(13, range=1..100)
wlc_eastcontextoffset = Slider(13, range=1..100)
wlc_southcontextheight = Slider(13, range=1..100)
wlc_eastcontextheight = Slider(15, range=1..100)
wlc_northcontextoffset = Slider(44, range=1..100)
wlc_westcontextoffset = Slider(23, range=1..100)
wlc_northcontextheight = Slider(18, range=1..100)
wlc_westcontextheight = Slider(11, range=1..100)
wires = BrepWireframe(Brep=rotate.Geometry, Density=-1)
split = SplitList(List=wires, Index="4")  # -> ListA, ListB
merge = Merge(Data1=item_9, Data2=item_10, Data3=item_11, Data4=item_12)  # -> graft(Result)
merge_2 = Merge(Data1=item_5, Data2=item_6, Data3=item_7, Data4=item_8)
offset = OffsetCurve(Curve=split.ListA, Distance=merge_2, Corners=1)
Z = UnitZ(Factor=merge)
midpt = CurveMiddle(Curve=graft(split.ListA))
midpt_2 = CurveMiddle(Curve=offset)
vec2pt = Vector2Pt(PointA=midpt, PointB=midpt_2, Unitize=Toggle(True))  # -> Vector, Length
extr = Extrude(Base=offset, Direction=Z)
multiplication = Multiplication(A=vec2pt.Vector, B="50")
extr_2 = Extrude(Base=extr, Direction=multiplication)  # -> flatten(Extrusion)

# ----
# 3. create ext shading
wlc_southshadingdepth = Slider(3, range=0..3)
wlc_eastshadingdepth = Slider(2, range=0..3)
wlc_northshadingdepth = Slider(0.5, range=0..3)
wlc_westshadingdepth = Slider(3, range=0..3)
split_2 = SplitList(List=split.ListB, Index="4")  # -> ListA, ListB
merge_3 = Merge(Data1=item_13, Data2=item_14, Data3=item_15, Data4=item_16)  # -> graft(Result)
multiplication_2 = Multiplication(A=vec2pt.Vector, B=merge_3)
extr_3 = Extrude(Base=graft(split_2.ListA), Direction=multiplication_2)  # -> flatten(Extrusion)

# ----
# 4. create ground context surface
panel_4 = Panel("100")
ext = ExtendCurve(Curve=offset, Type=0, Start=panel_4, End=panel_4)  # -> flatten(Curve)
item_29 = ListItem(List=ext, Index="0", Wrap=True)
item_30 = ListItem(List=ext, Index="1", Wrap=True)
item_31 = ListItem(List=ext, Index="2", Wrap=True)
item_32 = ListItem(List=ext, Index="3", Wrap=True)
ccx = CurveCurve(CurveA=item_29, CurveB=item_30)  # -> Points, ParamsA, ParamsB
ccx_2 = CurveCurve(CurveA=item_32, CurveB=item_29)  # -> Points, ParamsA, ParamsB
ccx_3 = CurveCurve(CurveA=item_30, CurveB=item_31)  # -> Points, ParamsA, ParamsB
ccx_4 = CurveCurve(CurveA=item_32, CurveB=item_31)  # -> Points, ParamsA, ParamsB
shatter = Shatter(Curve=item_29, Parameters=[ccx.ParamsA, ccx_2.ParamsB])
shatter_2 = Shatter(Curve=item_30, Parameters=[ccx_3.ParamsA, ccx.ParamsB])
shatter_3 = Shatter(Curve=item_31, Parameters=[ccx_4.ParamsB, ccx_3.ParamsB])
shatter_4 = Shatter(Curve=item_32, Parameters=[ccx_2.ParamsA, ccx_4.ParamsA])
item_33 = ListItem(List=shatter, Index="1", Wrap=True)
item_34 = ListItem(List=shatter_2, Index="1", Wrap=True)
item_35 = ListItem(List=shatter_3, Index="1", Wrap=True)
item_36 = ListItem(List=shatter_4, Index="1", Wrap=True)
join = JoinCurves(Curves=[item_33, item_34, item_35, item_36], Preserve=False)
boundary = BoundarySurfaces(Edges=join)

# ----
# 1b. split to floors
# hover over input for description
toggle = BooleanToggle(True)
split2floors = Honeybee_SplitBuildingMass2Floors(bldgMasses=rotate.Geometry, bldgsFlr2FlrHeights=item_2, runIt=toggle)  # -> readMe, flatten(splitBldgFloors); plug-in component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

# ----
# optional: assign basic programme(s) to zones
bldgprograms = Honeybee_bldgPrograms({"Office": 0, "Retail": 1, "MidriseApartment": 2, "PrimarySchool": 3, "SecondarySchool": 4, "SmallHotel": 5, "LargeHotel": 6, "Hospital": 7, "Outpatient": 8, "Warehouse": 9, "SuperMarket": 10, "FullServiceRestaurant": 11, "QuickServiceRestaurant": 12}, selected="Office")
listzoneprograms = Honeybee_ListZonePrograms(bldgProgram=bldgprograms)  # -> OfficeZonePrograms; plug-in component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
sel_sublist = Panel("3")
item_37 = ListItem(List=listzoneprograms, Index=sel_sublist, Wrap=True)
selected_programme = Panel(item_37)

# ----
# 1c. convert masses to HBzones
toggle_2 = BooleanToggle(True)
mass2zone = Honeybee_Masses2Zones(zoneMasses=flatten(split2floors.splitBldgFloors), maxRoofAngle=30, createHBZones=toggle_2)  # -> readMe, HBZones; plug-in component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

# ----
# 1d. solve adjacencies
toggle_3 = BooleanToggle(True)
solveadjc = Honeybee_SolveAdjacencies(HBZones=flatten(mass2zone.HBZones), removeCurrentAdjc=False, findAdjc=toggle_3)  # -> readMe, HBZonesWADJ; plug-in component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

# ----
# 1e. create ext walls and glazing
wlc_northwindowheight = Slider(3, range=0..10)
wlc_westwindowheight = Slider(4, range=0..10)
wlc_southwindowheight = Slider(4, range=0..10)
wlc_eastwindowheight = Slider(5, range=0..10)
wlc_northwindowsill = Slider(2, range=0..10)
wlc_westwindowsill = Slider(4, range=0..10)
wlc_southwindowsill = Slider(2, range=0..10)
wlc_eastwindowsill = Slider(1, range=0..10)
item_38 = ListItem(List=solveadjc.HBZonesWADJ, Index=0, Wrap=True)  # -> Item, Item1, Item2, Item3, Item4, Item5, Item6, Item7, Item8, Item9
wlc_southglazingratio = Slider(0.7, range=-0.1..0.9)
wlc_westglazingratio = Slider(0.9, range=-0.1..0.9)
wlc_eastglazingratio = Slider(0.6, range=-0.1..0.9)
wlc_northglazingratio = Slider(0.1, range=0.1..0.9)
# specify glazing parameters
relay = Relay([item_38.Item, item_38.Item7])

radglassmaterial = Honeybee_RadianceGlassMaterial(materialName="glassLowEMat", RTransmittance="0.6", GTransmittance="0.6", BTransmittance="0.6", refractiveIndex=1.52)  # -> avrgTrans, RADMaterial; plug-in component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

radglassmaterial_2 = Honeybee_RadianceGlassMaterial(materialName="glassClearMat", RTransmittance="0.88", GTransmittance="0.88", BTransmittance="0.88", refractiveIndex=1.52)  # -> avrgTrans, RADMaterial; plug-in component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

# ----
# specify a glazing ratio by orientation
glzparamlist = Honeybee_GlazingParametersList(northGlzParam=item_17, westGlzParam=item_18, southGlzParam=item_19, eastGlzParam=item_20)  # -> glzParamList; plug-in component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

# ----
# use clear and lowE glasses for different orientation
glzparamlist_2 = Honeybee_GlazingParametersList(
    northGlzParam=radglassmaterial.RADMaterial,
    westGlzParam=radglassmaterial.RADMaterial,
    southGlzParam=radglassmaterial_2.RADMaterial,
    eastGlzParam=radglassmaterial.RADMaterial)  # -> glzParamList; plug-in component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

# ----
# you can also specify different glazing parameters by orientation as well
glzparamlist_3 = Honeybee_GlazingParametersList(northGlzParam=item_25, westGlzParam=item_26, southGlzParam=item_27, eastGlzParam=item_28)  # -> glzParamList; plug-in component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
glzparamlist_4 = Honeybee_GlazingParametersList(northGlzParam=item_21, westGlzParam=item_22, southGlzParam=item_23, eastGlzParam=item_24)  # -> glzParamList; plug-in component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

glazingcreator = Honeybee_GlazingBasedOnRatio(
    HBObjects=relay,
    glzRatio=glzparamlist,
    breakUpWindow=Toggle(True),
    breakUpDist=Slider(3, range=2..5),
    windowHeight=glzparamlist_4,
    sillHeight=glzparamlist_3,
    RADMaterials=glzparamlist_2,
    runIt=Toggle(True))  # -> readMe, HBObjWGLZ; plug-in component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

# ----
# 1f. get window geometries
decomposebytype = Honeybee_DecomposeBasedOnType(HBZone=glazingcreator.HBObjWGLZ)  # -> walls, interiorWalls, airWalls, windows, interiorWindows, skylights, roofs, ceilings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; plug-in component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
item_39 = ListItem(List=flatten(decomposebytype.groundFloors), Index=0, Wrap=True)
item_40 = ListItem(List=flatten(decomposebytype.roofs), Index=0, Wrap=True)
preview = CustomPreview(Geometry=decomposebytype.walls, Material=ColourSwatch(SwatchColor=RGB(196, 196, 196)))
preview_2 = CustomPreview(Geometry=decomposebytype.windows, Material=ColourSwatch(SwatchColor=RGB(179, 235, 245)))
preview_3 = CustomPreview(Geometry=decomposebytype.roofs, Material=ColourSwatch(SwatchColor=RGB(130, 130, 130)))
preview_4 = CustomPreview(Geometry=decomposebytype.groundFloors, Material=ColourSwatch(SwatchColor=RGB(255, 255, 255)))

# ----
# 1g. create interior partitions and floors
srf = Surface(flatten(decomposebytype.groundFloors))
item_41 = ListItem(List=srf, Index=0, Wrap=True)
mplane = MeshPlane(Boundary=item_41, WidthCount="3", HeightCount="3")  # -> Mesh, Area
medges = MeshEdges(Mesh=mplane.Mesh)  # -> NakedEdges, InteriorEdges, NonManifoldEdges
faceb = FaceBoundaries(Mesh=mplane.Mesh)
boundary_2 = BoundarySurfaces(Edges=faceb)
crv = Curve(medges.InteriorEdges)
Z_2 = UnitZ(Factor=item_2)
extr_4 = Extrude(Base=crv, Direction=Z_2)

flip = Flip(Surface=item_39)  # -> Surface, Result
reflectance = Panel("0.3")
radopaquematerial = Honeybee_RadianceOpaqueMaterial(
    materialName="floorMat",
    RReflectance=reflectance,
    GReflectance=reflectance,
    BReflectance=reflectance,
    roughness=0.05,
    specularity=0)  # -> avrgRef, RADMaterial; plug-in component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
createhbsrfs = Honeybee_createHBSrfs(geometry=flip.Surface, RADMaterial=radopaquematerial.RADMaterial)  # -> readMe, simplify(HBSurface); plug-in component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

# ----
# either download
panel_5 = Panel("http://climate.onebuilding.org/WMO_Region_6_Europe/GRC_Greece/MH_Macedonia_and_Thrace/GRC_MH_Thessaloniki-Makedonia.AP.166220_TMYx.zip")
epw_stat = Ladybug_OpenEPWAndSTATWeatherFiles(weatherFileURL=panel_5)  # -> epwFile, statFile; plug-in component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

reflectance_2 = Panel("0.4")
radopaquematerial_2 = Honeybee_RadianceOpaqueMaterial(
    materialName="intWallsMat",
    RReflectance=reflectance_2,
    GReflectance=reflectance_2,
    BReflectance=reflectance_2,
    roughness=0.05,
    specularity=0)  # -> avrgRef, RADMaterial; plug-in component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
createhbsrfs_2 = Honeybee_createHBSrfs(geometry=extr_4, RADMaterial=radopaquematerial_2.RADMaterial)  # -> readMe, simplify(HBSurface); plug-in component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

# ----
# 2. Convert to HBsurfaces, generate openings and assign materials
panel_6 = Panel("groundMat")
reflectance_3 = Panel("0.25")
radopaquematerial_3 = Honeybee_RadianceOpaqueMaterial(
    materialName=panel_6,
    RReflectance=reflectance_3,
    GReflectance=reflectance_3,
    BReflectance=reflectance_3,
    roughness=0.05,
    specularity=0)  # -> avrgRef, RADMaterial; plug-in component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
createhbsrfs_3 = Honeybee_createHBSrfs(geometry=boundary, RADMaterial=radopaquematerial_3.RADMaterial)  # -> readMe, simplify(HBSurface); plug-in component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

reflectance_4 = Panel("0.4")
radopaquematerial_4 = Honeybee_RadianceOpaqueMaterial(
    materialName="ceilingMat",
    RReflectance=reflectance_4,
    GReflectance=reflectance_4,
    BReflectance=reflectance_4,
    roughness=0.05,
    specularity=0)  # -> avrgRef, RADMaterial; plug-in component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
createhbsrfs_4 = Honeybee_createHBSrfs(geometry=item_40, RADMaterial=radopaquematerial_4.RADMaterial)  # -> readMe, simplify(HBSurface); plug-in component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

reflectance_5 = Panel("0.35")
radopaquematerial_5 = Honeybee_RadianceOpaqueMaterial(
    materialName="extShadingMat",
    RReflectance=reflectance_5,
    GReflectance=reflectance_5,
    BReflectance=reflectance_5,
    roughness=0.05,
    specularity=0)  # -> avrgRef, RADMaterial; plug-in component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
createhbsrfs_5 = Honeybee_createHBSrfs(geometry=extr_3, RADMaterial=radopaquematerial_5.RADMaterial)  # -> readMe, simplify(HBSurface); plug-in component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

reflectance_6 = Panel("0.35")
radopaquematerial_6 = Honeybee_RadianceOpaqueMaterial(
    materialName="shadingContextMat",
    RReflectance=reflectance_6,
    GReflectance=reflectance_6,
    BReflectance=reflectance_6,
    roughness=0.05,
    specularity=0)  # -> avrgRef, RADMaterial; plug-in component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
createhbsrfs_6 = Honeybee_createHBSrfs(geometry=extr_2, RADMaterial=radopaquematerial_6.RADMaterial)  # -> readMe, simplify(HBSurface); plug-in component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

# ----
# or right click and set path to *.epw
path = FilePath("D:\LIBRARY\WEATHER_FILES\iwec2thess\Thess_iwec2.epw")

# ----
# 1. Load your *.epw weather file
importepw = Ladybug_ImportEpw(epwFile=epw_stat.epwFile)  # -> readMe, latitude, location, dryBulbTemperature, dewPointTemperature, relativeHumidity, windSpeed, windDirection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; plug-in component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

# ----
# preview surfaces
# filter glazed and opaque (last entry in list) srfs.
debrep = DeconstructBrep(Brep=glazingcreator.HBObjWGLZ)  # -> Faces, Edges, Vertices
item_42 = ListItem(List=reverse(debrep.Faces), Index=0, Wrap=True)
cull_i = CullIndex(List=debrep.Faces, Indices="-1", Wrap=True)

# ----
# merge final HB geometries
merge_4 = Merge(
    Data1=flatten(createhbsrfs_3.HBSurface),
    Data2=flatten(glazingcreator.HBObjWGLZ),
    Data3=flatten(createhbsrfs.HBSurface),
    Data4=flatten(createhbsrfs_2.HBSurface),
    Data5=flatten(createhbsrfs_4.HBSurface),
    Data6=flatten(createhbsrfs_5.HBSurface),
    Data7=flatten(createhbsrfs_6.HBSurface))
allhbgeometries = Data(merge_4)

preview_5 = CustomPreview(Geometry=createhbsrfs_2.HBSurface, Material=ColourSwatch(SwatchColor=RGB(219, 219, 219)))
preview_6 = CustomPreview(Geometry=createhbsrfs.HBSurface, Material=ColourSwatch(SwatchColor=RGB(255, 201, 201)))
preview_7 = CustomPreview(Geometry=item_42, Material=ColourSwatch(SwatchColor=RGB(255, 255, 255)))
preview_8 = CustomPreview(Geometry=cull_i, Material=ColourSwatch(SwatchColor=RGBA(13, 255, 231, 175)))
preview_9 = CustomPreview(Geometry=createhbsrfs_5.HBSurface, Material=ColourSwatch(SwatchColor=RGB(143, 143, 143)))
preview_10 = CustomPreview(Geometry=createhbsrfs_6.HBSurface, Material=ColourSwatch(SwatchColor=RGBA(143, 143, 143, 99)))

# ----
# 3. Prepare analysis recipe
# Generate test grid
resolution_m = Panel("0.5")  # disabled
height_of_analysis_plane_m = Panel("0.75")  # disabled
gentestpts = Honeybee_GenerateTestPoints(testGeometry=boundary_2, gridSize=resolution_m, distBaseSrf=height_of_analysis_plane_m, moveTestMesh=True)  # -> readMe, simplify(testPoints), simplify(ptsVectors), simplify(facesArea), simplify(mesh); disabled; plug-in component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

# ----
# Specify simulation parameters
# Suggested parameters from https://floyd.lbl.gov/radiance/refer/Notes/rpict_options.html
list = ValueList({"VeryLow": "1,512,256,128,0.15,0.004", "Low": "2,512,256,128,0.15,0.004", "Medium": "4,1024,256,256,0.1,0.004", "High": "1,4096,512,1024,0.1,0.001"}, selected="Medium")  # disabled
panel_7 = Panel(",")  # disabled
split_3 = TextSplit(Text=list, Separators=panel_7)  # disabled
item_43 = ListItem(List=split_3, Index=0, Wrap=True)  # -> Item, Item1, Item2, Item3, Item4; disabled
radparameters = Honeybee_RADParameters(quality=0, ab=item_43.Item, ad=item_43.Item1, as=item_43.Item2, ar=item_43.Item3, aa=item_43.Item4)  # -> readMe, radParameters; disabled; plug-in component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

# ----
# for Daylight Factor
daylighfactorsimulation = Honeybee_DaylightFactorSimulation(
    testPoints=gentestpts.testPoints,
    ptsVectors=gentestpts.ptsVectors,
    testMesh=gentestpts.mesh,
    uniformSky=False,
    radParameters=radparameters.radParameters)  # -> analysisRecipe; disabled; plug-in component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

# ----
# for annual
# daylighting study
annualdaylightsimulation = Honeybee_AnnualDaylightSimulation(
    epwWeatherFile=epw_stat.epwFile,
    testPoints=gentestpts.testPoints,
    ptsVectors=gentestpts.ptsVectors,
    testMesh=gentestpts.mesh,
    radParameters=radparameters.radParameters)  # -> analysisRecipe; disabled; plug-in component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

# ----
# 5. Daylight Autonomy
panel_8 = Panel("C:\Radiance\Thesis\DA")  # disabled
number_of_cpus = Panel("8")  # disabled

# ----
# specify occupancy schedule
panel_9 = Panel("17")  # disabled
panel_10 = Panel("9")  # disabled
analysisperiod = Ladybug_AnalysisPeriod(fromHour=panel_10, toHour=panel_9)  # -> readMe, analysisPeriod; disabled; plug-in component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
exclude_weekends = Panel("1,2")  # disabled
no_daily_off_hours = Panel("-1")  # disabled
toggle_4 = BooleanToggle(True)  # disabled
occupancygenerator = Honeybee_DaysimOccupancyGenerator(
    occupancyPeriod=analysisperiod.analysisPeriod,
    dailyOffHours=no_daily_off_hours,
    weekendDays=exclude_weekends,
    writeTheOcc=toggle_4)  # -> occupancyFile; disabled; plug-in component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

# ----
# Run simulation
run = BooleanToggle(True)  # disabled
rundaylightanalysis = Honeybee_RunDaylightSimulation(
    HBObjects=flatten(allhbgeometries),
    analysisRecipe=annualdaylightsimulation,
    writeRad=run,
    runRad=run,
    numOfCPUs=number_of_cpus,
    workingDir=panel_8,
    overwriteResults=True)  # -> readMe, analysisType, resultsUnit, results, testPts, annual_analysis_files, radGeoFile, studyFolder, done; disabled; plug-in component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

# ----
# post-process results
da_illumination_threshold_lux = Panel("300")  # disabled
run_2 = BooleanToggle(True)  # disabled
readannualresultsi = Honeybee_ReadAnnualResultI(
    illFilesAddress=rundaylightanalysis.annual_analysis_files,
    testPoints=simplify(rundaylightanalysis.testPts),
    occupancyFiles=occupancygenerator,
    DLAIllumThresholds=300,
    runIt=run_2)  # -> DLA, UDLI_Less_100, UDLI_100_2000, UDLI_More_2000, CDA, sDA, annualProfiles, htmReport; disabled; plug-in component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

number_slider = Slider(6, range=0..10)  # disabled
gradientlibrary = Ladybug_GradientLibrary(gradIndex=number_slider)  # -> customColors; disabled; plug-in component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
legend = Legend(Colour=gradientlibrary, Tags=["One Fish", "Two Fish", "Red Fish", "Blue Fish"], LegendType=1)  # disabled

number_slider_2 = Slider(6, range=0..10)  # disabled
panel_11 = Panel("100")  # disabled
panel_12 = Panel("0")  # disabled
legendpar = Ladybug_LegendParameters(lowBound=panel_12, highBound=panel_11, numSegments=number_slider_2, customColors=flatten(gradientlibrary))  # -> legendPar; disabled; plug-in component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

panel_13 = Panel("9")  # disabled
panel_14 = Panel("17")  # disabled
analysisperiod_2 = Ladybug_AnalysisPeriod(fromHour=panel_13, toHour=panel_14)  # -> readMe, analysisPeriod; disabled; plug-in component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
toggle_5 = BooleanToggle(True)  # disabled
panel_15 = Panel("-1")  # disabled
panel_16 = Panel("0")  # disabled
occupancygenerator_2 = Honeybee_DaysimOccupancyGenerator(occupancyPeriod=analysisperiod_2.analysisPeriod, dailyOffHours=panel_15, weekendDays=panel_16, writeTheOcc=toggle_5)  # -> occupancyFile; disabled; plug-in component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
panel_17 = Panel("365")  # disabled
subtraction = Subtraction(A=panel_14, B=panel_13)  # disabled
multiplication_3 = Multiplication(A=subtraction, B=panel_17)  # disabled

panel_18 = Panel("C:\Radiance\Thesis\ASE")  # disabled
number_of_cpus_2 = Panel("8")  # disabled

# ----
# 6. Annual Sunlight Exposure
# ASE should account ONLY for direct sun (no ambient bounces)
panel_19 = Panel("0")  # disabled
radparameters_2 = Honeybee_RADParameters(quality=0, ab=panel_19)  # -> readMe, radParameters; disabled; plug-in component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
annualdaylightsimulation_2 = Honeybee_AnnualDaylightSimulation(
    epwWeatherFile=epw_stat.epwFile,
    testPoints=gentestpts.testPoints,
    ptsVectors=gentestpts.ptsVectors,
    testMesh=gentestpts.mesh,
    radParameters=radparameters_2.radParameters)  # -> analysisRecipe; disabled; plug-in component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
# this part was adapted from S. Mohtar GH def. for IAAC daylighting course (2021)
toogle = BooleanToggle(True)  # disabled
rundaylightanalysis_2 = Honeybee_RunDaylightSimulation(
    HBObjects=flatten(allhbgeometries),
    analysisRecipe=annualdaylightsimulation_2,
    writeRad=toogle,
    runRad=toogle,
    numOfCPUs=number_of_cpus_2,
    workingDir=panel_18,
    overwriteResults=True)  # -> readMe, analysisType, resultsUnit, results, testPts, annual_analysis_files, radGeoFile, studyFolder, done; disabled; plug-in component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

moveabovetestsrf = Slider(1, range=0..10)  # disabled
number_slider_3 = Slider(0.7, range=0.2..5)  # disabled

# ----
# generate text
flatten = FlattenTree(Tree=readannualresultsi.sDA, Path="{0}")  # disabled
panel_20 = Panel("sDA =")  # disabled
panel_21 = Panel("%")  # disabled
lng = ListLength(List=flatten)  # disabled
repeat = RepeatData(Data=panel_20, Length=lng)  # disabled
repeat_2 = RepeatData(Data=panel_21, Length=lng)  # disabled
entwine = Entwine(Branch00=repeat, Branch01=flatten, Branch02=repeat_2, FlattenInputs=True)  # disabled
flip_2 = FlipMatrix(Data=entwine)  # disabled
panel_22 = Panel(" ")  # disabled
join_2 = TextJoin(Text=flip_2, Join=panel_22)  # disabled

# ----
# Visualize DA results
recolormesh = Ladybug_RecolorMesh(analysisResult=readannualresultsi.DLA, inputMesh=gentestpts.mesh, legendPar=legendpar)  # -> readMe, newMesh, newLegend, legendBasePt, meshColors, legendColors; disabled; plug-in component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

# ----
# change legend position
pt_2 = Point(Point(-18.50194556, -153.4395027, 5.3618493))  # disabled

panel_23 = Panel("Daylight Availability (%)")  # disabled
number_slider_4 = Slider(3, range=1..10)  # disabled
createlegend = Ladybug_CreateLegend(
    valuesOrRange=[panel_12, panel_11],
    legendBasePt=pt_2,
    legendTitle=panel_23,
    legendSize=number_slider_4,
    legendPar=legendpar)  # -> legendMesh, legendTextSrf, legendBasePt, port, textValuesBasePts, legendTextValues, recommendedTextSize; disabled; plug-in component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

area_2 = Area(Geometry=boundary_2)  # -> Area, Centroid; disabled
Z_3 = UnitZ(Factor=moveabovetestsrf)  # disabled
move = Move(Geometry=area_2.Centroid, Motion=Z_3)  # -> Geometry, Transform; disabled

# ----
# Recolored DA meshes
mesh = Mesh(recolormesh.newMesh)  # disabled

# ----
# Lux Threshold
panel_24 = Panel("1000")  # disabled

run_3 = BooleanToggle(True)  # disabled
readannualresultsi_2 = Honeybee_ReadAnnualResultI(
    illFilesAddress=rundaylightanalysis_2.annual_analysis_files,
    testPoints=simplify(rundaylightanalysis_2.testPts),
    occupancyFiles=occupancygenerator_2,
    DLAIllumThresholds=panel_24,
    runIt=run_3)  # -> DLA, UDLI_Less_100, UDLI_100_2000, UDLI_More_2000, CDA, sDA, annualProfiles, htmReport; disabled; plug-in component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

# ----
# generate text
avr = Average(Input=readannualresultsi.UDLI_100_2000)  # disabled
flatten_2 = FlattenTree(Tree=avr, Path="{0}")  # disabled
panel_25 = Panel("UDI =")  # disabled
panel_26 = Panel("%")  # disabled
lng_2 = ListLength(List=flatten_2)  # disabled
repeat_3 = RepeatData(Data=panel_25, Length=lng_2)  # disabled
repeat_4 = RepeatData(Data=panel_26, Length=lng_2)  # disabled
entwine_2 = Entwine(Branch00=repeat_3, Branch01=flatten_2, Branch02=repeat_4, FlattenInputs=True)  # disabled
flip_3 = FlipMatrix(Data=entwine_2)  # disabled
panel_27 = Panel(" ")  # disabled
join_3 = TextJoin(Text=flip_3, Join=panel_27)  # disabled

moveabovetestsrf_2 = Slider(1, range=0..10)  # disabled
number_slider_5 = Slider(0.7, range=0.2..5)  # disabled

# ----
# Occupied Hours Per Year Threshold
panel_28 = Panel("250")  # disabled

multiplication_4 = Multiplication(A=multiplication_3, B=readannualresultsi_2.DLA)  # disabled
panel_29 = Panel("100")  # disabled
division = Division(A=multiplication_4, B=panel_29)  # disabled
larger = LargerThan(FirstNumber=division, SecondNumber=panel_28)  # -> LargerThan, OrEqualTo; disabled
ma = MassAddition(Input=larger.OrEqualTo)  # -> Result, PartialResults; disabled
lng_3 = ListLength(List=larger.OrEqualTo)  # disabled
not = GateNot(A=larger.OrEqualTo)  # disabled
division_2 = Division(A=ma.Result, B=lng_3)  # disabled
swatch = ColourSwatch(SwatchColor=RGB(112, 250, 158))  # disabled
panel_30 = Panel("100")  # disabled
cullf = CullFaces(Mesh=gentestpts.mesh, Pattern=not)  # disabled
multiplication_5 = Multiplication(A=division_2, B=panel_30)  # disabled
mcol = MeshColours(Mesh=cullf, Colours=swatch)  # disabled
python = GhPythonScript(x=multiplication_5)  # -> out, a; disabled
# ---------- python: Python ----------
a = round(x, 2)
# ---------- end python ----------
mjoin = MeshJoin(Meshes=mcol)  # disabled

# ---- group: writer
# Compile dataset
avr_2 = Average(Input=readannualresultsi.UDLI_100_2000)  # disabled
labels = Panel("""roomNumber
FloorHeight
Width
Length
Rotation
SouthContextOffset
EastContextOffset
NorthContextOffset
WestContextOffset
SouthContextHeight
EastContextHeight
NorthContextHeight
WestContextHeight
SouthShadingDepth
EastShadingDepth
NorthShadingDepth
WestShadingDepth
NorthGlazingRatio
WestGlazingRatio
SouthGlazingRatio
EastGlazingRatio
NorthWindowHeight
WestWindowHeight
SouthWindowHeight
EastWindowHeight
NorthWindowSill
WestWindowSill
SouthWindowSill
EastWindowSill
sDA
UDI
ASE""")  # disabled
merge_5 = Merge(
    Data1=flatten(animate),
    Data2=flatten(item_2),
    Data3=flatten(item),
    Data4=flatten(item_3),
    Data5=flatten(item_4),
    Data6=flatten(item_5),
    Data7=flatten(item_6),
    Data8=flatten(item_7),
    Data9=flatten(item_8),
    Data10=flatten(item_9),
    Data11=flatten(item_10),
    Data12=flatten(item_11),
    Data13=flatten(item_12),
    Data14=flatten(item_13),
    Data15=flatten(item_14),
    Data16=flatten(item_15),
    Data17=flatten(item_16),
    Data18=flatten(item_17),
    Data19=flatten(item_18),
    Data20=flatten(item_19),
    Data21=flatten(item_20),
    Data22=flatten(item_21),
    Data23=flatten(item_22),
    Data24=flatten(item_23),
    Data25=flatten(item_24),
    Data26=flatten(item_25),
    Data27=flatten(item_26),
    Data28=flatten(item_27),
    Data29=flatten(item_28),
    Data30=flatten(readannualresultsi.sDA),
    Data31=flatten(avr_2),
    Data32=flatten(python.a))  # disabled
panel_31 = Panel(",")  # disabled
panel_32 = Panel(",")  # disabled
join_4 = TextJoin(Text=merge_5, Join=panel_31)  # disabled
join_5 = TextJoin(Text=labels, Join=panel_32)  # disabled
toggle_6 = BooleanToggle(False)  # disabled
number_slider_6 = Slider(1, range=0..10)  # disabled
export_robotmotion_3_r3_multi = PythonScript(toggle=toggle_6, path=panel_3, x=join_4, labs=join_5, y=number_slider_6)  # disabled
# ---------- export_robotmotion_3_r3_multi: Python ----------
#script by Gabriella Rossi / CITA
import os
from os import listdir
from os.path import isfile, join
from scriptcontext import sticky as st

if True:
    #Create file
    filename = str(path)
    fil = open(filename, 'a+')
    
    if y < 1 :

        #write header and first line
        fil.write(labs)
        fil.write('\n' + x)
    else:
        #just write line
        fil.write('\n' + x)

    fil.close()
# ---------- end export_robotmotion_3_r3_multi ----------

# ----
panel_33 = Panel(join_4)

area_3 = Area(Geometry=boundary_2)  # -> Area, Centroid; disabled
Z_4 = UnitZ(Factor=moveabovetestsrf_2)  # disabled
move_2 = Move(Geometry=area_3.Centroid, Motion=Z_4)  # -> Geometry, Transform; disabled

# ----
# generate text
flatten_3 = FlattenTree(Tree=python.a, Path="{0}")  # disabled
panel_34 = Panel("ASE =")  # disabled
panel_35 = Panel("%")  # disabled
lng_4 = ListLength(List=flatten_3)  # disabled
repeat_5 = RepeatData(Data=panel_34, Length=lng_4)  # disabled
repeat_6 = RepeatData(Data=panel_35, Length=lng_4)  # disabled
entwine_3 = Entwine(Branch00=repeat_5, Branch01=flatten_3, Branch02=repeat_6, FlattenInputs=True)  # disabled
flip_4 = FlipMatrix(Data=entwine_3)  # disabled
panel_36 = Panel(" ")  # disabled
join_6 = TextJoin(Text=flip_4, Join=panel_36)  # disabled

moveabovetestsrf_3 = Slider(1, range=0..10)  # disabled
number_slider_7 = Slider(0.7, range=0.2..5)  # disabled

swatch_2 = ColourSwatch(SwatchColor=RGB(21, 0, 255))  # disabled
panel_37 = Panel("5")  # disabled

area_4 = Area(Geometry=boundary_2)  # -> Area, Centroid; disabled
Z_5 = UnitZ(Factor=moveabovetestsrf_3)  # disabled
move_3 = Move(Geometry=area_4.Centroid, Motion=Z_5)  # -> Geometry, Transform; disabled

# ----
# ASE
mesh_2 = Mesh(mjoin)  # disabled

swatch_3 = ColourSwatch(SwatchColor=RGB(21, 0, 255))  # disabled

# ----
# Annotate rooms with sDA (%)
panel_38 = Panel("0,0,0")  # disabled
panel_39 = Panel("2,2,0")  # disabled
sda_per_room = Panel(join_2)  # disabled
vec2pt_2 = Vector2Pt(PointA=panel_38, PointB=panel_39, Unitize=False)  # -> Vector, Length; disabled
swatch_4 = ColourSwatch(SwatchColor=RGB(21, 0, 255))  # disabled
panel_40 = Panel("5")  # disabled

move_4 = Move(Geometry=move.Geometry, Motion=vec2pt_2.Vector)  # -> Geometry, Transform; disabled

tag = TextTag3D(Location=move_4.Geometry, Text=flatten(join_2), Size=number_slider_3, Colour=swatch_4, Justification=panel_40)  # disabled

# ----
# Annotate rooms with UDI (%)
panel_41 = Panel("0,0,0")  # disabled
panel_42 = Panel("2,-2,0")  # disabled
sda_per_room_2 = Panel(join_3)  # disabled
vec2pt_3 = Vector2Pt(PointA=panel_41, PointB=panel_42, Unitize=False)  # -> Vector, Length; disabled

move_5 = Move(Geometry=move_2.Geometry, Motion=vec2pt_3.Vector)  # -> Geometry, Transform; disabled

tag_2 = TextTag3D(Location=move_5.Geometry, Text=flatten(join_3), Size=number_slider_5, Colour=swatch_2, Justification=panel_37)  # disabled

# ----
# Annotate rooms with ASE (%)
# rooms with ASE>10% may have glare/overheating issues
panel_43 = Panel("0,0,0")  # disabled
panel_44 = Panel("2,2,0")  # disabled
vec2pt_4 = Vector2Pt(PointA=panel_43, PointB=panel_44, Unitize=False)  # -> Vector, Length; disabled
panel_45 = Panel("5")  # disabled
sda_per_room_3 = Panel(join_6)  # disabled

move_6 = Move(Geometry=move_3.Geometry, Motion=vec2pt_4.Vector)  # -> Geometry, Transform; disabled

tag_3 = TextTag3D(Location=move_6.Geometry, Text=flatten(join_6), Size=number_slider_7, Colour=swatch_3, Justification=panel_45)  # disabled
