# Grasshopper definition roomsGenerator.gh (Grasshopper 1.0.7)
# plug-ins: Pufferfish, Wallacei

# ----
# 1a. create building mass
wlc_length = Slider(10, range=10..100)
wlc_floorheight = Slider(4, range=3..10)
wlc_width = Slider(17, range=10..100)
rectangle = Rectangle(Plane=PlaneXY(0, 0, 0), XSize=wlc_width, YSize=wlc_length, Radius=0)  # -> Rectangle, Length
wlc_rotation = Slider(-10, range=-44..45)
area = Area(Geometry=rectangle.Rectangle)  # -> Area, Centroid
pt = ConstructPoint(XCoordinate=0, YCoordinate=0, ZCoordinate=0)
move2pt = MoveToPoint(Geometry=rectangle.Rectangle, PointA=area.Centroid, PointB=pt)  # -> Moved, Vector, Transform
boxrec = BoxRectangle(Rectangle=move2pt.Moved, Height=wlc_floorheight)
rotate = Rotate(Geometry=boxrec, Angle=degrees(wlc_rotation), Plane=PlaneXY(0, 0, 0))  # -> Geometry, Transform

# ----
# 2. create context masses
# Shadow Length = Height/tan(x),
# where x = angle of the sun's altitude
wlc_westcontextheight = Slider(102, range=1..500)
wlc_southcontextoffset = Slider(19, range=1..100)
wlc_eastcontextoffset = Slider(54, range=1..100)
wlc_northcontextoffset = Slider(45, range=1..100)
wlc_westcontextoffset = Slider(71, range=1..100)
wlc_southcontextheight = Slider(193, range=1..500)
wlc_eastcontextheight = Slider(315, range=1..500)
wlc_northcontextheight = Slider(433, range=1..500)
wires = BrepWireframe(Brep=rotate.Geometry, Density=-1)
split = SplitList(List=wires, Index="4")  # -> ListA, ListB
merge = Merge(Data1=wlc_southcontextheight, Data2=wlc_eastcontextheight, Data3=wlc_northcontextheight, Data4=wlc_westcontextheight)  # -> graft(Result)
merge_2 = Merge(Data1=wlc_southcontextoffset, Data2=wlc_eastcontextoffset, Data3=wlc_northcontextoffset, Data4=wlc_westcontextoffset)
offset = OffsetCurve(Curve=split.ListA, Distance=merge_2, Corners=1)
Z = UnitZ(Factor=merge)
midpt = CurveMiddle(Curve=graft(split.ListA))
midpt_2 = CurveMiddle(Curve=offset)
vec2pt = Vector2Pt(PointA=midpt, PointB=midpt_2, Unitize=Toggle(True))  # -> Vector, Length
extr = Extrude(Base=offset, Direction=Z)
multiplication = Multiplication(A=vec2pt.Vector, B="50")
extr_2 = Extrude(Base=extr, Direction=multiplication)  # -> flatten(Extrusion)

ladybug = Ladybug_Ladybug()  # -> Vviiiiiiiiiizzz; plug-in component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
honeybee = Honeybee_Honeybee()  # -> Vviiiiiiiiiizzz; plug-in component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

# ----
# 3. create shading
wlc_southshadingdepth = Slider(0.45, range=0..3)
wlc_eastshadingdepth = Slider(0.43, range=0..3)
wlc_northshadingdepth = Slider(2.89, range=0..3)
wlc_westshadingdepth = Slider(0.62, range=0..3)
split_2 = SplitList(List=split.ListB, Index="4")  # -> ListA, ListB
merge_3 = Merge(Data1=wlc_southshadingdepth, Data2=wlc_eastshadingdepth, Data3=wlc_northshadingdepth, Data4=wlc_westshadingdepth)  # -> graft(Result)
multiplication_2 = Multiplication(A=vec2pt.Vector, B=merge_3)
extr_3 = Extrude(Base=graft(split_2.ListA), Direction=multiplication_2)  # -> flatten(Extrusion)

# ----
# 4. create context surface
panel = Panel("1000")
ext = ExtendCurve(Curve=offset, Type=0, Start=panel, End=panel)  # -> flatten(Curve)
item = ListItem(List=ext, Index="0", Wrap=True)
item_2 = ListItem(List=ext, Index="1", Wrap=True)
item_3 = ListItem(List=ext, Index="2", Wrap=True)
item_4 = ListItem(List=ext, Index="3", Wrap=True)
ccx = CurveCurve(CurveA=item, CurveB=item_2)  # -> Points, ParamsA, ParamsB
ccx_2 = CurveCurve(CurveA=item_4, CurveB=item)  # -> Points, ParamsA, ParamsB
ccx_3 = CurveCurve(CurveA=item_2, CurveB=item_3)  # -> Points, ParamsA, ParamsB
ccx_4 = CurveCurve(CurveA=item_4, CurveB=item_3)  # -> Points, ParamsA, ParamsB
shatter = Shatter(Curve=item, Parameters=[ccx.ParamsA, ccx_2.ParamsB])
shatter_2 = Shatter(Curve=item_2, Parameters=[ccx_3.ParamsA, ccx.ParamsB])
shatter_3 = Shatter(Curve=item_3, Parameters=[ccx_4.ParamsB, ccx_3.ParamsB])
shatter_4 = Shatter(Curve=item_4, Parameters=[ccx_2.ParamsA, ccx_4.ParamsA])
item_5 = ListItem(List=shatter, Index="1", Wrap=True)
item_6 = ListItem(List=shatter_2, Index="1", Wrap=True)
item_7 = ListItem(List=shatter_3, Index="1", Wrap=True)
item_8 = ListItem(List=shatter_4, Index="1", Wrap=True)
join = JoinCurves(Curves=[item_5, item_6, item_7, item_8], Preserve=False)
boundary = BoundarySurfaces(Edges=join)

shuffler = GenePoolAndSliderShuffler(BooleanButton=Button())

# ----
# 1b. split to floors
# hover over input for description
toggle = BooleanToggle(True)
split2floors = Honeybee_SplitBuildingMass2Floors(bldgMasses=rotate.Geometry, bldgsFlr2FlrHeights=wlc_floorheight, runIt=toggle)  # -> readMe, flatten(splitBldgFloors); plug-in component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

# ----
# optional: assign basic programme(s) to zones
bldgprograms = Honeybee_bldgPrograms({"Office": 0, "Retail": 1, "MidriseApartment": 2, "PrimarySchool": 3, "SecondarySchool": 4, "SmallHotel": 5, "LargeHotel": 6, "Hospital": 7, "Outpatient": 8, "Warehouse": 9, "SuperMarket": 10, "FullServiceRestaurant": 11, "QuickServiceRestaurant": 12}, selected="Office")
listzoneprograms = Honeybee_ListZonePrograms(bldgProgram=bldgprograms)  # -> OfficeZonePrograms; plug-in component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
sel_sublist = Panel("3")
item_9 = ListItem(List=listzoneprograms, Index=sel_sublist, Wrap=True)
selected_programme = Panel(item_9)

# ----
# 1c. convert masses to HBzones
toggle_2 = BooleanToggle(True)
mass2zone = Honeybee_Masses2Zones(zoneMasses=flatten(split2floors.splitBldgFloors), maxRoofAngle=30, createHBZones=toggle_2)  # -> readMe, HBZones; plug-in component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

# ----
# 1d. solve adjacencies
toggle_3 = BooleanToggle(True)
solveadjc = Honeybee_SolveAdjacencies(HBZones=flatten(mass2zone.HBZones), removeCurrentAdjc=False, findAdjc=toggle_3)  # -> readMe, HBZonesWADJ; plug-in component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

# ----
# 1e. create ext walls and glazing
# specify glazing parameters
wlc_northwindowheight = Slider(1, range=0..10)
wlc_westwindowheight = Slider(1, range=0..10)
wlc_southwindowheight = Slider(4, range=0..10)
wlc_eastwindowheight = Slider(7, range=0..10)
wlc_northwindowsill = Slider(5, range=0..5)
wlc_westwindowsill = Slider(2, range=0..5)
wlc_southwindowsill = Slider(4, range=0..5)
wlc_eastwindowsill = Slider(1, range=0..5)
item_10 = ListItem(List=solveadjc.HBZonesWADJ, Index=0, Wrap=True)  # -> Item, Item1, Item2, Item3, Item4, Item5, Item6, Item7, Item8, Item9
wlc_northglazingratio = Slider(0.4, range=0..0.9)
wlc_westglazingratio = Slider(0.2, range=0..0.9)
wlc_southglazingratio = Slider(0.6, range=0..0.9)
wlc_eastglazingratio = Slider(0.3, range=0..0.9)
relay = Relay([item_10.Item, item_10.Item7])

# ----
# specify a glazing ratio by orientation
glzparamlist = Honeybee_GlazingParametersList(
    northGlzParam=wlc_northglazingratio,
    westGlzParam=wlc_westglazingratio,
    southGlzParam=wlc_southglazingratio,
    eastGlzParam=wlc_eastglazingratio)  # -> glzParamList; plug-in component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

# ----
# you can also specify different glazing parameters by orientation as well
glzparamlist_2 = Honeybee_GlazingParametersList(
    northGlzParam=wlc_northwindowsill,
    westGlzParam=wlc_westwindowsill,
    southGlzParam=wlc_southwindowsill,
    eastGlzParam=wlc_eastwindowsill)  # -> glzParamList; plug-in component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
glzparamlist_3 = Honeybee_GlazingParametersList(
    northGlzParam=wlc_northwindowheight,
    westGlzParam=wlc_westwindowheight,
    southGlzParam=wlc_southwindowheight,
    eastGlzParam=wlc_eastwindowheight)  # -> glzParamList; plug-in component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

glazingcreator = Honeybee_GlazingBasedOnRatio(
    HBObjects=relay,
    glzRatio=glzparamlist,
    breakUpWindow=Toggle(True),
    breakUpDist=Slider(3, range=2..5),
    windowHeight=glzparamlist_3,
    sillHeight=glzparamlist_2,
    runIt=Toggle(True))  # -> readMe, HBObjWGLZ; plug-in component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

# ----
# 1f. get window geometries
decomposebytype = Honeybee_DecomposeBasedOnType(HBZone=glazingcreator.HBObjWGLZ)  # -> walls, interiorWalls, airWalls, windows, interiorWindows, skylights, roofs, ceilings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; plug-in component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
item_11 = ListItem(List=flatten(decomposebytype.groundFloors), Index=0, Wrap=True)
item_12 = ListItem(List=flatten(decomposebytype.roofs), Index=0, Wrap=True)
preview = CustomPreview(Geometry=decomposebytype.roofs, Material=ColourSwatch(SwatchColor=RGB(130, 130, 130)))
preview_2 = CustomPreview(Geometry=decomposebytype.walls, Material=ColourSwatch(SwatchColor=RGBA(255, 255, 255, 169)))
preview_3 = CustomPreview(Geometry=decomposebytype.windows, Material=ColourSwatch(SwatchColor=RGB(76, 219, 245)))
preview_4 = CustomPreview(Geometry=decomposebytype.groundFloors, Material=ColourSwatch(SwatchColor=RGB(255, 255, 255)))
geo = Geometry(decomposebytype.walls)
geo_2 = Geometry(decomposebytype.windows)

# ----
# 1g. create interior partitions
srf = Surface(flatten(decomposebytype.groundFloors))
item_13 = ListItem(List=srf, Index=0, Wrap=True)
mplane = MeshPlane(Boundary=item_13, WidthCount="3", HeightCount="3")  # -> Mesh, Area
medges = MeshEdges(Mesh=mplane.Mesh)  # -> NakedEdges, InteriorEdges, NonManifoldEdges
faceb = FaceBoundaries(Mesh=mplane.Mesh)
boundary_2 = BoundarySurfaces(Edges=faceb)
crv = Curve(medges.InteriorEdges)
Z_2 = UnitZ(Factor=wlc_floorheight)
extr_4 = Extrude(Base=crv, Direction=Z_2)

merge_4 = Merge(Data1=extr_2, Data2=extr_3, Data3=extr_4, Data4=geo, Data5=geo_2, Data6=item_11)

# ----
# objectives
addition = Addition(A=wlc_width, B=wlc_length)
merge_5 = Merge(Data1=wlc_southcontextheight, Data2=wlc_eastcontextheight, Data3=wlc_northcontextheight, Data4=wlc_westcontextheight)
merge_6 = Merge(Data1=wlc_southcontextheight, Data2=wlc_eastcontextheight, Data3=wlc_northcontextheight, Data4=wlc_westcontextheight)
merge_7 = Merge(Data1=wlc_southcontextoffset, Data2=wlc_eastcontextoffset, Data3=wlc_northcontextoffset, Data4=wlc_westcontextoffset)
merge_8 = Merge(Data1=wlc_northglazingratio, Data2=wlc_westglazingratio, Data3=wlc_southglazingratio, Data4=wlc_eastglazingratio)
merge_9 = Merge(Data1=wlc_northglazingratio, Data2=wlc_westglazingratio, Data3=wlc_southglazingratio, Data4=wlc_eastglazingratio)
merge_10 = Merge(Data1=wlc_northwindowheight, Data2=wlc_westwindowheight, Data3=wlc_southwindowheight, Data4=wlc_eastwindowheight)
merge_11 = Merge(Data1=wlc_northwindowheight, Data2=wlc_westwindowheight, Data3=wlc_southwindowheight, Data4=wlc_eastwindowheight)
merge_12 = Merge(Data1=wlc_southshadingdepth, Data2=wlc_eastshadingdepth, Data3=wlc_northshadingdepth, Data4=wlc_westshadingdepth)
merge_13 = Merge(Data1=wlc_southshadingdepth, Data2=wlc_eastshadingdepth, Data3=wlc_northshadingdepth, Data4=wlc_westshadingdepth)
wlc_floorarea_maximize = Number(area.Area)
wlc_height_maximize = Number(wlc_floorheight)
wlc_length_width_minimize = Number(addition)
ma = MassAddition(Input=merge_5)  # -> Result, PartialResults
mm = MassMultiplication(Input=merge_6)  # -> Result, PartialResults
ma_2 = MassAddition(Input=merge_7)  # -> Result, PartialResults
ma_3 = MassAddition(Input=merge_8)  # -> Result, PartialResults
mm_2 = MassMultiplication(Input=merge_9)  # -> Result, PartialResults
mm_3 = MassMultiplication(Input=merge_10)  # -> Result, PartialResults
ma_4 = MassAddition(Input=merge_11)  # -> Result, PartialResults
mm_4 = MassMultiplication(Input=merge_13)  # -> Result, PartialResults
ma_5 = MassAddition(Input=merge_12)  # -> Result, PartialResults
area_2 = Area(Geometry=boxrec)  # -> Area, Centroid
multiplication_3 = Multiplication(A=wlc_floorarea_maximize, B="2")
wlc_glazingratiomultiplication_maximize = Number(mm_2.Result)
wlc_contextheightmultiplication_minimize = Number(mm.Result)
wlc_contextheightaddition_minimize = Number(ma.Result)
wlc_glazingratioaddition_maximize = Number(ma_3.Result)
wlc_contextoffset_maximize = Number(ma_2.Result)
wlc_shadingdepthmultiplication_maximize = Number(mm_4.Result)
wlc_windowheight_maximize = Number(mm_3.Result)
wlc_shadingdepthaddition_minimize = Number(ma_5.Result)
wlc_windowsill_minimize = Number(ma_4.Result)
subtraction = Subtraction(A=area_2.Area, B=multiplication_3)
one_over_x = OneOverX(Value=wlc_length_width_minimize)
wlc_wallarea_minimize = Number(subtraction)
one_over_x_2 = OneOverX(Value=wlc_windowsill_minimize)
one_over_x_3 = OneOverX(Value=wlc_shadingdepthaddition_minimize)
one_over_x_4 = OneOverX(Value=wlc_contextheightaddition_minimize)
one_over_x_5 = OneOverX(Value=wlc_contextheightmultiplication_minimize)
one_over_x_6 = OneOverX(Value=wlc_wallarea_minimize)

merge_14 = Merge(
    Data1=wlc_floorheight,
    Data2=wlc_width,
    Data3=wlc_length,
    Data4=wlc_rotation,
    Data5=wlc_southcontextoffset,
    Data6=wlc_eastcontextoffset,
    Data7=wlc_northcontextoffset,
    Data8=wlc_westcontextoffset,
    Data9=wlc_southcontextheight,
    Data10=wlc_eastcontextheight,
    Data11=wlc_northcontextheight,
    Data12=wlc_westcontextheight,
    Data13=wlc_southshadingdepth,
    Data14=wlc_eastshadingdepth,
    Data15=wlc_northshadingdepth,
    Data16=wlc_westshadingdepth,
    Data17=wlc_northglazingratio,
    Data18=wlc_westglazingratio,
    Data19=wlc_southglazingratio,
    Data20=wlc_eastglazingratio,
    Data21=wlc_northwindowheight,
    Data22=wlc_westwindowheight,
    Data23=wlc_southwindowheight,
    Data24=wlc_eastwindowheight,
    Data25=wlc_northwindowsill,
    Data26=wlc_westwindowsill,
    Data27=wlc_southwindowsill,
    Data28=wlc_eastwindowsill)

# ----
# generate rooms and site model
wallacei_x = WallaceiX(
    Genes=[wlc_eastcontextheight, wlc_eastcontextoffset, wlc_eastshadingdepth, wlc_eastwindowheight, wlc_floorheight, wlc_eastwindowsill, wlc_length, wlc_northcontextheight, wlc_northcontextoffset, wlc_northshadingdepth, wlc_northwindowheight, wlc_rotation, wlc_southcontextheight, wlc_northwindowsill, wlc_southcontextoffset, wlc_southshadingdepth, wlc_westcontextheight, wlc_southwindowheight, wlc_westcontextoffset, wlc_westshadingdepth, wlc_width, wlc_southwindowsill, wlc_westwindowsill, wlc_westwindowheight, wlc_eastglazingratio, wlc_northglazingratio, wlc_southglazingratio, wlc_westglazingratio],
    Objectives=[one_over_x_6, wlc_floorarea_maximize, wlc_height_maximize, one_over_x, one_over_x_4, wlc_contextoffset_maximize, wlc_glazingratioaddition_maximize, wlc_glazingratiomultiplication_maximize, wlc_windowheight_maximize, one_over_x_2, one_over_x_3, wlc_shadingdepthmultiplication_maximize, one_over_x_5],
    Data=merge_14,
    Phenotype=merge_4,
    allFitness="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",
    allFrontIdx="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",
    allGenomes="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",
    curFrontIdx="9|0;9|1;9|2;9|3;9|4;9|5;9|6;9|7;9|8;9|9;9|10;9|11;9|12;9|13;9|14;9|15;9|16;9|17;9|18;9|19;9|20;9|21;9|22;9|23;9|24;9|25;9|26;9|27;9|28;9|29;9|30;9|31;9|32;9|33;9|34;9|35;9|36;9|37;9|38;9|39;9|40;9|41;9|42;9|43;9|44;9|45;9|46;9|47;9|48;9|49;9|50;9|51;9|52;9|53;9|54;9|55;9|56;9|57;9|58;9|59;9|60;9|61;9|62;9|63;9|64;9|65;9|66;9|67;9|68;9|69;9|70;9|71;9|72;9|73;9|74;9|75;9|76;9|77;9|78;9|79;9|80;9|81;9|82;9|83;9|84;9|85;9|86;9|87;9|88;9|89;9|90;9|91;9|92;9|93;9|94;9|95;9|96;9|97;9|98;9|99",
    curFrontIdxSave="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",
    popGen="100,10",
    total="174016",
    wlcDone=True)  # -> WallaceiGenomes, FitnessValues, Data, WPhenotypes
distributor = DistributeToGrid(
    FitnessValues=wallacei_x.FitnessValues,
    Data=wallacei_x.Data,
    WallaceiPhenotypes=wallacei_x.WPhenotypes,
    SizeOfTheGridInTheXDirection="500",
    SizeOfTheGridInTheYDirection="500",
    OutputOptions=0)  # -> DistributedFitnessValues, DistributedData, DistributedGeometries, DistributedMeshes, DistributedNumbers, GridLocations

# ----
# results
input_data_moreobjectives_lessheight = Number(Tree({0;0;0}: [4, 17, 82, -41, 39, 41, 23, 73, 2, 116, 67, 106, 0.84, 0.5, 0.03, 0.27, 0.7, 0.8, 0.6, 0.8, 8, 7, 2, 10, 3, 2, 2, 2], {0;1;0}: [4, 41, 41, -36, 27, 69, 69, 3, 7, 16, 128, 144, 1.5, 2.78, 2.23, 1.47, 0.8, 0.4, 0.5, 0.1, 7, 6, 6, 10, 1, 3, 2, 0], {0;2;0}: [8, 17, 41, 42, 60, 44, 9, 6, 26, 12, 80, 83, 2.88, 0.27, 2.36, 2.43, 0.1, 0.6, 0.5, 0.7, 9, 3, 6, 3, 3, 4, 4, 4], {0;3;0}: [6, 90, 80, -29, 42, 31, 66, 33, 139, 8, 39, 95, 0.53, 2.72, 1.17, 2.43, 0.7, 0.2, 0.3, 0.8, 4, 4, 0, 2, 4, 0, 3, 5], {0;4;0}: [5, 47, 54, -21, 31, 75, 88, 89, 114, 100, 117, 31, 0.48, 1.5, 2.16, 1.04, 0.7, 0.3, 0.6, 0.8, 5, 7, 9, 5, 2, 4, 3, 4], {0;5;0}: [7, 44, 63, -27, 30, 48, 89, 6, 38, 36, 136, 79, 2.72, 1.08, 2.86, 1.66, 0, 0.1, 0.7, 0.8, 9, 10, 1, 7, 3, 1, 5, 3]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))
input_data_moreobjectives1 = Number(Tree({0;0;0}: [8, 95, 42, -22, 69, 12, 11, 71, 161, 125, 472, 142, 1.96, 1.4, 1.93, 2.11, 0.2, 0.3, 0.7, 0.7, 0, 4, 6, 8, 5, 1, 0, 2], {0;1;0}: [8, 32, 99, 3, 69, 89, 86, 68, 137, 412, 403, 218, 1.16, 1.67, 0.19, 1.42, 0.6, 0.1, 0.4, 0.3, 5, 2, 7, 7, 5, 3, 2, 0], {0;2;0}: [7, 46, 21, -17, 80, 9, 10, 43, 499, 475, 108, 51, 0.66, 2.92, 0.94, 2.87, 0.3, 0.4, 0.1, 0.4, 5, 1, 2, 5, 4, 5, 4, 0], {0;3;0}: [7, 60, 87, -24, 31, 39, 10, 48, 437, 181, 387, 64, 0.37, 1.11, 0.08, 1.11, 0.4, 0.2, 0.7, 0.2, 9, 2, 4, 0, 2, 0, 2, 4], {0;4;0}: [10, 53, 87, -30, 14, 85, 94, 9, 11, 70, 350, 147, 0.22, 2.99, 1.62, 2.78, 0.6, 0, 0.8, 0.8, 7, 1, 2, 3, 0, 5, 4, 3], {0;5;0}: [4, 26, 67, -24, 19, 21, 4, 36, 311, 160, 120, 342, 1.76, 2.23, 1.7, 1.6, 0.7, 0.3, 0.6, 0.3, 2, 1, 3, 2, 3, 4, 5, 3]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))
input_data_moreobjectives2 = Number(Tree({0;0;0}: [8, 95, 42, -22, 69, 12, 11, 71, 161, 125, 472, 142, 1.96, 1.4, 1.93, 2.11, 0.2, 0.3, 0.7, 0.7, 0, 4, 6, 8, 5, 1, 0, 2], {0;1;0}: [8, 32, 99, 3, 69, 89, 86, 68, 137, 412, 403, 218, 1.16, 1.67, 0.19, 1.42, 0.6, 0.1, 0.4, 0.3, 5, 2, 7, 7, 5, 3, 2, 0], {0;2;0}: [7, 46, 21, -17, 80, 9, 10, 43, 499, 475, 108, 51, 0.66, 2.92, 0.94, 2.87, 0.3, 0.4, 0.1, 0.4, 5, 1, 2, 5, 4, 5, 4, 0], {0;3;0}: [7, 60, 87, -24, 31, 39, 10, 48, 437, 181, 387, 64, 0.37, 1.11, 0.08, 1.11, 0.4, 0.2, 0.7, 0.2, 9, 2, 4, 0, 2, 0, 2, 4], {0;4;0}: [10, 53, 87, -30, 14, 85, 94, 9, 11, 70, 350, 147, 0.22, 2.99, 1.62, 2.78, 0.6, 0, 0.8, 0.8, 7, 1, 2, 3, 0, 5, 4, 3], {0;5;0}: [4, 26, 67, -24, 19, 21, 4, 36, 311, 160, 120, 342, 1.76, 2.23, 1.7, 1.6, 0.7, 0.3, 0.6, 0.3, 2, 1, 3, 2, 3, 4, 5, 3]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))
input_data_sept3 = Data(Tree({0;0;0}: [8, 75, 28, -38, 39, 8, 42, 9, 191, 446, 265, 361, 1.52, 0.35, 1.35, 1.35, 0.9, 0.8, 0.6, 0.7, 6, 2, 2, 7, 3, 4, 3, 0], {0;1;0}: [4, 30, 82, -1, 87, 96, 11, 4, 213, 455, 9, 162, 0.47, 1.15, 2.46, 0.82, 0.1, 0.3, 0.5, 0.4, 2, 2, 6, 2, 1, 2, 0, 1], {0;2;0}: [6, 76, 66, -36, 41, 92, 7, 3, 362, 148, 226, 494, 2.71, 2.58, 1.35, 1.69, 0.3, 0.7, 0.6, 0.8, 9, 2, 6, 7, 2, 4, 3, 1], {0;3;0}: [8, 72, 75, -33, 10, 24, 96, 55, 272, 255, 95, 366, 2.62, 2.22, 1.61, 2.59, 0, 0.6, 0.5, 0.1, 1, 8, 9, 1, 2, 1, 3, 3], {0;4;0}: [7, 58, 95, -25, 94, 66, 72, 3, 322, 22, 418, 240, 1.35, 2.31, 2.19, 0.95, 0.7, 0.9, 0.1, 0.7, 4, 0, 9, 10, 1, 2, 0, 4], {0;5;0}: [10, 64, 23, 22, 17, 93, 77, 23, 239, 32, 153, 270, 0, 0.2, 0.4, 1.44, 0.2, 0, 0.1, 0, 5, 2, 3, 6, 1, 2, 4, 0]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))
input_data_first_run = Number(Tree({0;0;0}: [8, 95, 42, -22, 69, 12, 11, 71, 161, 125, 472, 142, 1.96, 1.4, 1.93, 2.11, 0.2, 0.3, 0.7, 0.7, 0, 4, 6, 8, 5, 1, 0, 2], {0;1;0}: [8, 32, 99, 3, 69, 89, 86, 68, 137, 412, 403, 218, 1.16, 1.67, 0.19, 1.42, 0.6, 0.1, 0.4, 0.3, 5, 2, 7, 7, 5, 3, 2, 0], {0;2;0}: [7, 46, 21, -17, 80, 9, 10, 43, 499, 475, 108, 51, 0.66, 2.92, 0.94, 2.87, 0.3, 0.4, 0.1, 0.4, 5, 1, 2, 5, 4, 5, 4, 0], {0;3;0}: [7, 60, 87, -24, 31, 39, 10, 48, 437, 181, 387, 64, 0.37, 1.11, 0.08, 1.11, 0.4, 0.2, 0.7, 0.2, 9, 2, 4, 0, 2, 0, 2, 4], {0;4;0}: [10, 53, 87, -30, 14, 85, 94, 9, 11, 70, 350, 147, 0.22, 2.99, 1.62, 2.78, 0.6, 0, 0.8, 0.8, 7, 1, 2, 3, 0, 5, 4, 3], {0;5;0}: [4, 26, 67, -24, 19, 21, 4, 36, 311, 160, 120, 342, 1.76, 2.23, 1.7, 1.6, 0.7, 0.3, 0.6, 0.3, 2, 1, 3, 2, 3, 4, 5, 3]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))

fitnessvalues_moreobjectives2 = Number(Tree({0;0}: [0.001263, 1394, 4, 0.010101, 0.003436, 176, 2.9, 0.2688, 1120, 0.037037, 0.609756, 0.003402, 6.0692e-07], {0;1}: [0.001524, 1681, 4, 0.012195, 0.00339, 168, 1.8, 0.016, 2520, 0.034483, 0.125313, 13.669677, 4.8441e-07], {0;2}: [0.001078, 697, 8, 0.017241, 0.004975, 119, 1.9, 0.021, 486, 0.047619, 0.125945, 4.45938, 4.827e-07], {0;3}: [0.00049, 7200, 6, 0.005882, 0.003559, 172, 2, 0.0336, 0, 0.1, 0.145985, 4.098613, 2.4272e-07], {0;4}: [0.00099, 2538, 5, 0.009901, 0.002762, 283, 2.4, 0.1008, 1575, 0.038462, 0.19305, 1.617408, 2.4185e-08], {0;5}: [0.000668, 2772, 7, 0.009346, 0.00346, 173, 1.6, 0, 630, 0.037037, 0.120192, 13.94655, 6.8037e-08]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))

# ----
# visualize geometry
geo_3 = Geometry(simplify(distributor.DistributedGeometries))
split_3 = SplitTree(Data=geo_3, Masks=flatten("{?}"))  # -> Positive, Negative
split_4 = SplitTree(Data=geo_3, Masks=flatten("{?;?}"))  # -> Positive, Negative
split_5 = SplitTree(Data=geo_3, Masks=flatten("{?;?;?;?}"))  # -> Positive, Negative
preview_5 = CustomPreview(Geometry=geo_3, Material=ColourSwatch(SwatchColor=RGB(168, 168, 168)))
split_6 = SplitList(List=split_3.Positive, Index="4")  # -> ListA, ListB
split_7 = SplitList(List=split_6.ListB, Index="4")  # -> ListA, ListB
range = Range(Domain=Domain(0, 1), Steps="2")
gradient = Gradient(LowerLimit=0, UpperLimit=1, Parameter=range, stops=[0.15: RGB(255, 130, 160), 0.85: RGB(220, 0, 40)])
gradient_2 = Gradient(LowerLimit=0, UpperLimit=1, Parameter=range, stops=[0.15: RGB(142, 222, 209), 0.85: RGB(2, 110, 86)])
gradient_3 = Gradient(LowerLimit=0, UpperLimit=1, Parameter=range, stops=[0.15: RGB(198, 130, 237), 0.85: RGB(71, 47, 105)])
gradient_4 = Gradient(LowerLimit=0, UpperLimit=1, Parameter=range, stops=[0.15: RGB(192, 255, 255), 0.85: RGB(0, 192, 192)])
item_14 = ListItem(List=gradient, Index="0", Wrap=True)  # -> flatten(Item)
item_15 = ListItem(List=gradient_3, Index="0", Wrap=True)
item_16 = ListItem(List=gradient_2, Index="0", Wrap=True)
item_17 = ListItem(List=gradient_4, Index="0", Wrap=True)  # -> flatten(Item)
preview_6 = CustomPreview(Geometry=split_6.ListA, Material=item_16)
preview_7 = CustomPreview(Geometry=split_7.ListA, Material=item_15)
preview_8 = CustomPreview(Geometry=split_7.ListB, Material=ColourSwatch(SwatchColor=RGB(255, 234, 0)))
preview_9 = CustomPreview(Geometry=split_4.Positive, Material=item_14)
preview_10 = CustomPreview(Geometry=split_5.Positive, Material=item_14)
