# Grasshopper definition Node.gh (Grasshopper 1.0.7)
# plug-ins: Kangaroo2 Components

count = Slider(12, range=2..20)
pt = Point([Point(-2.279058233, -2.654066595, 0), Point(3.634670789, -6.297846119, 0), Point(-1.392897076, 2.152555762, 0)])
points = GetPoint(pt, AtLeast=1, AtMost=2147483647, Realtime=True)
height = GetNumber(count, AtLeast=1, AtMost=2147483647, Maximum=1.797693135e+308, Minimum=-1.797693135e+308)
dimension = GetNumber(Slider(200, range=0..1000), AtLeast=1, AtMost=2147483647, Maximum=1.797693135e+308, Minimum=-1.797693135e+308)
sph = Sphere(Base=PlaneXY(0, 0, 0), Radius=dimension)
pt_2 = ConstructPoint(XCoordinate=0, YCoordinate=0, ZCoordinate=0)
division = Division(A=dimension, B=height)
popgeo = PopulateGeometry(Geometry=sph, Count=height, Seed=1)
pull = PullPoint(Point=popgeo, Geometry=points, ClosestOnly=True)  # -> ClosestPoint, Distance
ln = Line(StartPoint=pull.ClosestPoint, EndPoint=popgeo)
mp = MultiPipe(Curves=ln, NodeSize=division, EndOffset=1, StrutSize=1, Segment=0, KinkAngle=0.6, CubeFit=0)
meshsubd = MeshFromSubD(SubD=mp, Density=2)
clean = CombineClean(Meshes=meshsubd)
pt_3 = ConstructPoint(XCoordinate=0, YCoordinate=0, ZCoordinate=0)
medges = MeshEdges(Mesh=clean)  # -> NakedEdges, InteriorEdges, NonManifoldEdges
merge = Merge(Data1=medges.NakedEdges, Data2=medges.InteriorEdges)  # -> flatten(Result)
curvepoint = PointOnCurve(merge, parameter=0.5)
pull_2 = PullPoint(Point=curvepoint, Geometry=pt_3, ClosestOnly=True)  # -> ClosestPoint, Distance
bnd = Bounds(Numbers=pull_2.Distance)
remap = RemapNumbers(Value=pull_2.Distance, Source=bnd, Target=Domain(0, 1))  # -> Mapped, Clipped
gradient = Gradient(
    LowerLimit=0,
    UpperLimit=1,
    Parameter=remap.Mapped,
    stops=[0: RGB(0, 34, 255), 0.5: RGB(255, 0, 85), 1: RGB(255, 153, 0)])
c_script = CSharpScript(crv=merge, color=gradient)  # -> out, A; inputs crv: Curve, color: Color
# ---------- c_script: C# ----------
    var c = color.R + "," + color.G + "," + color.B;
    crv.SetUserString("color", c);
    A = crv;
# ---------- end c_script ----------

# ---- group: RH_OUT:crvs
crv = Curve(c_script.A)
