# Grasshopper definition Studio_Recreation_Hops.gh (Grasshopper 1.0.7)

panel = Panel("phase1")
panel_2 = Panel("phase2")
panel_3 = Panel("phase3")
panel_4 = Panel("phase4")
geo = Geometry([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])
geo_2 = Geometry([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])
geo_3 = Geometry([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])
geo_4 = Geometry([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])
get_number = GetNumber(Slider(3, range=0..3), AtLeast=1, AtMost=1, Maximum=1.797693135e+308, Minimum=-1.797693135e+308)
filter = StreamFilter(Gate=get_number, Stream0=geo, Stream1=geo_2, Stream2=geo_3, Stream3=geo_4)

# ---- group: RH_OUT:brep
geo_5 = Geometry(filter)
