# Grasshopper definition dayLite.gh (Grasshopper 1.0.7)
# plug-ins: Pufferfish, Heteroptera, Hops

# ----
# 1a. create building mass
floorheight = Slider(8, range=3..10)
width = Slider(45, range=10..100)
length = Slider(85, range=10..100)
rotation = Slider(0, range=-44..45)
floorheight_2 = GetNumber(floorheight, AtLeast=1, AtMost=1, Maximum=1.797693135e+308, Minimum=-1.797693135e+308, TreeAccess=False)
width_2 = GetNumber(width, AtLeast=1, AtMost=1, Maximum=1.797693135e+308, Minimum=-1.797693135e+308, TreeAccess=False)
length_2 = GetNumber(length, AtLeast=1, AtMost=1, Maximum=1.797693135e+308, Minimum=-1.797693135e+308, TreeAccess=False)
rotation_2 = GetNumber(rotation, AtLeast=1, AtMost=1, Maximum=1.797693135e+308, Minimum=-1.797693135e+308, TreeAccess=False)
rectangle = Rectangle(Plane=PlaneXY(0, 0, 0), XSize=width_2, YSize=length_2, Radius=0)  # -> Rectangle, Length
area = Area(Geometry=rectangle.Rectangle)  # -> Area, Centroid
pt = ConstructPoint(XCoordinate=0, YCoordinate=0, ZCoordinate=0)
move2pt = MoveToPoint(Geometry=rectangle.Rectangle, PointA=area.Centroid, PointB=pt)  # -> Moved, Vector, Transform
boxrec = BoxRectangle(Rectangle=move2pt.Moved, Height=floorheight_2)
rotate = Rotate(Geometry=boxrec, Angle=degrees(rotation_2), Plane=PlaneXY(0, 0, 0))  # -> Geometry, Transform

# ----
# 2. create context masses
# Shadow Length = Height/tan(x),
# where x = angle of the sun's altitude
westcontextheight = Slider(20, range=1..150)
southcontextoffset = Slider(50, range=1..100)
eastcontextoffset = Slider(70, range=1..100)
southcontextheight = Slider(150, range=1..150)
eastcontextheight = Slider(40, range=1..150)
northcontextoffset = Slider(90, range=1..100)
westcontextoffset = Slider(100, range=1..100)
northcontextheight = Slider(100, range=1..150)
wires = BrepWireframe(Brep=rotate.Geometry, Density=-1)
split = SplitList(List=wires, Index="4")  # -> ListA, ListB
southcontextoffset_2 = GetNumber(southcontextoffset, AtLeast=1, AtMost=1, Maximum=50, Minimum=20, TreeAccess=False)
eastcontextoffset_2 = GetNumber(eastcontextoffset, AtLeast=1, AtMost=1, Maximum=50, Minimum=20, TreeAccess=False)
northcontextoffset_2 = GetNumber(northcontextoffset, AtLeast=1, AtMost=1, Maximum=50, Minimum=20, TreeAccess=False)
westcontextoffset_2 = GetNumber(westcontextoffset, AtLeast=1, AtMost=1, Maximum=50, Minimum=20, TreeAccess=False)
southcontextheight_2 = GetNumber(southcontextheight, AtLeast=1, AtMost=1, Maximum=50, Minimum=20, TreeAccess=False)
eastcontextheight_2 = GetNumber(eastcontextheight, AtLeast=1, AtMost=1, Maximum=50, Minimum=20, TreeAccess=False)
northcontextheight_2 = GetNumber(northcontextheight, AtLeast=1, AtMost=1, Maximum=50, Minimum=20, TreeAccess=False)
westcontextheight_2 = GetNumber(westcontextheight, AtLeast=1, AtMost=1, Maximum=50, Minimum=20, TreeAccess=False)
merge = Merge(Data1=southcontextheight_2, Data2=eastcontextheight_2, Data3=northcontextheight_2, Data4=westcontextheight_2)  # -> graft(Result)
merge_2 = Merge(Data1=southcontextoffset_2, Data2=eastcontextoffset_2, Data3=northcontextoffset_2, Data4=westcontextoffset_2)
offset = OffsetCurve(Curve=split.ListA, Distance=merge_2, Corners=1)
Z = UnitZ(Factor=merge)
midpt = CurveMiddle(Curve=graft(split.ListA))
midpt_2 = CurveMiddle(Curve=offset)
vec2pt = Vector2Pt(PointA=midpt, PointB=midpt_2, Unitize=Toggle(True))  # -> Vector, Length
extr = Extrude(Base=offset, Direction=Z)
multiplication = Multiplication(A=vec2pt.Vector, B="50")
extr_2 = Extrude(Base=extr, Direction=multiplication)  # -> flatten(Extrusion)

# ----
# 3. create shading
northshadingdepth = Slider(0.5, range=0..3)
westshadingdepth = Slider(2, range=0..3)
southshadingdepth = Slider(3, range=0..3)
eastshadingdepth = Slider(1, range=0..3)
split_2 = SplitList(List=split.ListB, Index="4")  # -> ListA, ListB
southshadingdepth_2 = GetNumber(southshadingdepth, AtLeast=1, AtMost=1, Maximum=50, Minimum=20, TreeAccess=False)
westshadingdepth_2 = GetNumber(westshadingdepth, AtLeast=1, AtMost=1, Maximum=50, Minimum=20, TreeAccess=False)
eastshadingdepth_2 = GetNumber(eastshadingdepth, AtLeast=1, AtMost=1, Maximum=50, Minimum=20, TreeAccess=False)
northshadingdepth_2 = GetNumber(northshadingdepth, AtLeast=1, AtMost=1, Maximum=50, Minimum=20, TreeAccess=False)
merge_3 = Merge(Data1=southshadingdepth_2, Data2=eastshadingdepth_2, Data3=northshadingdepth_2, Data4=westshadingdepth_2)
multiplication_2 = Multiplication(A=vec2pt.Vector, B=graft(merge_3))
extr_3 = Extrude(Base=graft(split_2.ListA), Direction=multiplication_2)  # -> flatten(Extrusion)

# ----
# 5. simplified to not affect the geometry, but still used as inputs into machine learning model
northwindowheight = Slider(3, range=0..10)
westwindowheight = Slider(3, range=0..10)
southwindowheight = Slider(3, range=0..10)
eastwindowheight = Slider(3, range=0..10)
northwindowsill = Slider(2, range=0..5)
westwindowsill = Slider(2, range=0..5)
southwindowsill = Slider(2, range=0..5)
eastwindowsill = Slider(2, range=0..5)
northwindowheight_2 = GetNumber(northwindowheight, AtLeast=1, AtMost=1, Maximum=50, Minimum=20, TreeAccess=False)
westwindowheight_2 = GetNumber(westwindowheight, AtLeast=1, AtMost=1, Maximum=50, Minimum=20, TreeAccess=False)
southwindowheight_2 = GetNumber(southwindowheight, AtLeast=1, AtMost=1, Maximum=50, Minimum=20, TreeAccess=False)
eastwindowheight_2 = GetNumber(eastwindowheight, AtLeast=1, AtMost=1, Maximum=50, Minimum=20, TreeAccess=False)
westwindowsill_2 = GetNumber(westwindowsill, AtLeast=1, AtMost=1, Maximum=50, Minimum=20, TreeAccess=False)
northwindowsill_2 = GetNumber(northwindowsill, AtLeast=1, AtMost=1, Maximum=50, Minimum=20, TreeAccess=False)
southwindowsill_2 = GetNumber(southwindowsill, AtLeast=1, AtMost=1, Maximum=50, Minimum=20, TreeAccess=False)
eastwindowsill_2 = GetNumber(eastwindowsill, AtLeast=1, AtMost=1, Maximum=50, Minimum=20, TreeAccess=False)

# ----
# 4. create windows
southglazingratio = Slider(0.2, range=0..0.9)
eastglazingratio = Slider(0.9, range=0..0.9)
westglazingratio = Slider(0.6, range=0..0.9)
northglazingratio = Slider(0.9, range=0..0.9)
northglazingratio_2 = GetNumber(northglazingratio, AtLeast=1, AtMost=1, Maximum=50, Minimum=20, TreeAccess=False)
westglazingratio_2 = GetNumber(westglazingratio, AtLeast=1, AtMost=1, Maximum=50, Minimum=20, TreeAccess=False)
southglazingratio_2 = GetNumber(southglazingratio, AtLeast=1, AtMost=1, Maximum=50, Minimum=20, TreeAccess=False)
eastglazingratio_2 = GetNumber(eastglazingratio, AtLeast=1, AtMost=1, Maximum=50, Minimum=20, TreeAccess=False)
multiplication_3 = Multiplication(A=floorheight_2, B=westglazingratio_2)
multiplication_4 = Multiplication(A=floorheight_2, B=southglazingratio_2)
multiplication_5 = Multiplication(A=floorheight_2, B=eastglazingratio_2)
multiplication_6 = Multiplication(A=floorheight_2, B=northglazingratio_2)
merge_4 = Merge(Data1=multiplication_3, Data2=multiplication_4, Data3=multiplication_5, Data4=multiplication_6)
center = Center(Geometric=rotate.Geometry)  # -> Center, Dimension
pdecon = Deconstruct(Point=center.Center)  # -> XComponent, YComponent, ZComponent

equals = Equality(FirstNumber=merge_4, SecondNumber="0")  # -> Equality, Inequality
cull = CullPattern(List=split.ListA, CullPattern=equals.Inequality)
cull_2 = CullPattern(List=merge_4, CullPattern=equals.Inequality)

join = JoinCurves(Curves=cull, Preserve=False)
offset_2 = OffsetCurve(Curve=join, Distance="0.1", Corners=1)
explode = Explode(Curve=offset_2, Recursive=True)  # -> Segments, Vertices
Z_2 = UnitZ(Factor=cull_2)  # -> graft(UnitVector)
crv = Curve(graft(explode.Segments))
midpt_3 = CurveMiddle(Curve=crv)
extr_4 = Extrude(Base=crv, Direction=Z_2)
vec2pt_2 = Vector2Pt(PointA="0,0,0", PointB=midpt_3, Unitize=Toggle(True))  # -> graft(Vector), Length
multiplication_7 = Multiplication(A=vec2pt_2.Vector, B="0.1")
extr_5 = Extrude(Base=extr_4, Direction=multiplication_7)
center_2 = Center(Geometric=extr_5)  # -> flatten(Center), Dimension
pdecon_2 = Deconstruct(Point=center_2.Center)  # -> XComponent, YComponent, ZComponent
subtraction = Subtraction(A=pdecon.ZComponent, B=pdecon_2.ZComponent)
Z_3 = UnitZ(Factor=subtraction)  # -> graft(UnitVector)
move = Move(Geometry=extr_5, Motion=Z_3)  # -> flatten(Geometry), Transform

# ----
# 6. create and sort colors
panel = Panel("2")
range = Range(Domain=Domain(0, 1), Steps=panel)
gradient = Gradient(LowerLimit=0, UpperLimit=1, Parameter=range, stops=[0.15: RGB(255, 130, 160), 0.85: RGB(220, 0, 40)])
gradient_2 = Gradient(LowerLimit=0, UpperLimit=1, Parameter=range, stops=[0.15: RGB(142, 222, 209), 0.85: RGB(2, 110, 86)])
gradient_3 = Gradient(LowerLimit=0, UpperLimit=1, Parameter=range, stops=[0.15: RGB(198, 130, 237), 0.85: RGB(71, 47, 105)])
gradient_4 = Gradient(LowerLimit=0, UpperLimit=1, Parameter=range, stops=[0.15: RGB(192, 255, 255), 0.85: RGB(0, 192, 192)])
item = ListItem(List=gradient, Index="0", Wrap=True)  # -> flatten(Item)
item_2 = ListItem(List=gradient_3, Index="0", Wrap=True)
item_3 = ListItem(List=gradient_2, Index="1", Wrap=True)
item_4 = ListItem(List=gradient_4, Index="0", Wrap=True)  # -> flatten(Item)
lng = ListLength(List=extr_2)
lng_2 = ListLength(List=extr_3)
lng_3 = ListLength(List=move.Geometry)
repeat = RepeatData(Data=item_3, Length=lng)  # -> flatten(Data)
repeat_2 = RepeatData(Data=item_2, Length=lng_2)  # -> flatten(Data)
repeat_3 = RepeatData(Data=item_4, Length=lng_3)  # -> flatten(Data)
merge_5 = Merge(Data1=item, Data2=repeat, Data3=repeat_2, Data4=repeat_3)

# ----
# use hops to make predictions
panel_2 = Panel("http://f901-34-75-119-140.ngrok.io/hello3")
hops = Hops(
    _Path=panel_2,
    FloorHeight=floorheight_2,
    Width=width_2,
    Length=length_2,
    Rotation=rotation_2,
    SouthContextOffset=southcontextoffset_2,
    EastContextOffset=eastcontextoffset_2,
    NorthContextOffset=northcontextoffset_2,
    WestContextOffset=westcontextoffset_2,
    SouthContextHeight=southcontextheight_2,
    EastContextHeight=eastcontextheight_2,
    NorthContextHeight=northcontextheight_2,
    WestContextHeight=westcontextheight_2,
    SouthShadingDepth=southshadingdepth_2,
    EastShadingDepth=eastshadingdepth_2,
    NorthShadingDepth=northshadingdepth_2,
    WestShadingDepth=westshadingdepth_2,
    NorthGlazingRatio=northglazingratio_2,
    WestGlazingRatio=westglazingratio_2,
    SouthGlazingRatio=southglazingratio_2,
    EastGlazingRatio=eastglazingratio_2,
    NorthWindowHeight=northwindowheight_2,
    WestWindowHeight=westwindowheight_2,
    SouthWindowHeight=southwindowheight_2,
    EastWindowHeight=eastwindowheight_2,
    NorthWindowSill=northwindowsill_2,
    WestWindowSill=westwindowsill_2,
    SouthWindowSill=southwindowsill_2,
    EastWindowSill=eastwindowsill_2,
    CacheResultsInMemory=True,
    CacheSolveResults=True,
    RemoteDefinitionLocation="http://f901-34-75-119-140.ngrok.io/hello3",
    RemoteSolveVersion=(0, 1, 0),
    ShowInput_Enabled=False,
    ShowInput_Path=True,
    SynchronousSolve=True)  # -> SDA, UDI, ASE
panel_3 = Panel(hops.SDA)
panel_4 = Panel(hops.ASE)
panel_5 = Panel(hops.UDI)

# ----
# 7. add colors to mesh
merge_6 = Merge(Data1=rotate.Geometry, Data2=extr_2, Data3=extr_3, Data4=move.Geometry)
mesh = MeshBrep(
    Brep=merge_6,
    Settings={GridMaxCount=0, GridMinCount=16, JaggedSeams=False, MaxEdgeLength=0, MinEdgeLength=0.0001, MinTolerance=0, Refine=True, RefineAngle=0, RelativeTolerance=0.65, SimplePlanes=True, Tolerance=0})
demesh = DeconstructMesh(Mesh=mesh)  # -> Vertices, Faces, Colours, Normals
conmesh = ConstructMesh(Vertices=demesh.Vertices, Faces=demesh.Faces, Colours=graft(merge_5))  # -> flatten(Mesh)
c_script = CSharpScript(mesh=conmesh, color=merge_5)  # -> out, A; inputs mesh: Mesh, color: Color
# ---------- c_script: C# ----------
    var c = color.R + "," + color.G + "," + color.B;
    A = mesh;
# ---------- end c_script ----------

# ---- group: RH_OUT:sDA
data = Data(hops.SDA)

# ---- group: RH_OUT:UDI
data_2 = Data(hops.UDI)

# ---- group: RH_OUT:ASE
data_3 = Data(hops.ASE)

# ---- group: RH_OUT:mesh
mesh_2 = Mesh(c_script.A)
