# Grasshopper definition rnd_node.gh (Grasshopper 1.0.7)
# plug-ins: Kangaroo2 Components

radius = Slider(16, range=5..20)
count = Slider(8, range=2..20)
radiusssss = GetNumber(radius, AtLeast=1, AtMost=2147483647, Maximum=1.797693135e+308, Minimum=-1.797693135e+308)
count_2 = GetNumber(count, AtLeast=1, AtMost=2147483647, Maximum=1.797693135e+308, Minimum=-1.797693135e+308)
sph = Sphere(Base=PlaneXY(0, 0, 0), Radius=radiusssss)
pt = ConstructPoint(XCoordinate=0, YCoordinate=0, ZCoordinate=0)
popgeo = PopulateGeometry(Geometry=sph, Count=count_2, Seed=1)
division = Division(A=radiusssss, B=count_2)
ln = Line(StartPoint=pt, EndPoint=popgeo)
mp = MultiPipe(Curves=ln, NodeSize=division, EndOffset=1, StrutSize=1, Segment=0, KinkAngle=0.6, CubeFit=0)
meshsubd = MeshFromSubD(SubD=mp, Density=2)
medges = MeshEdges(Mesh=meshsubd)  # -> NakedEdges, InteriorEdges, NonManifoldEdges
preview = CustomPreview(Geometry=meshsubd, Material=ColourSwatch(SwatchColor=RGB(255, 255, 255)))

# ---- group: RH_OUT:edges
crv = Curve([medges.NakedEdges, medges.InteriorEdges])

# ---- group: RH_OUT:mesh
mesh = Mesh(meshsubd)
