# Grasshopper definition test - Copy.gh (Grasshopper 1.0.7)

Y = GetInteger(Slider(6, range=0..10), AtLeast=1, AtMost=1, Maximum=2147483647, Minimum=-2147483648)
Z = GetInteger(Slider(7, range=0..10), AtLeast=1, AtMost=1, Maximum=2147483647, Minimum=-2147483648)
X = GetInteger(Slider(6, range=0..10), AtLeast=1, AtMost=1, Maximum=2147483647, Minimum=-2147483648)
box = CenterBox(Base=PlaneXY(0, 0, 0), X=X, Y=Y, Z=Z)

# ---- group: RH_OUT:outbox
mesh = Mesh(box)
