# Grasshopper definition test.gh (Grasshopper 1.0.7)

count = GetInteger(Slider(1, range=0..100), AtLeast=1, AtMost=1, Maximum=2147483647, Minimum=-2147483648)
pt = ConstructPoint(XCoordinate=0, YCoordinate=0, ZCoordinate=0)
random = Random(Range=Domain(0, 1), Number=count, Seed=2)
random_2 = Random(Range=Domain(0, 1), Number=count, Seed=count)
sph = Sphere(Base=pt, Radius=1)
vec = VectorXYZ(XComponent=random, YComponent=random_2, ZComponent=0)  # -> Vector, Length
evalsrf = EvaluateSurface(Surface=reparameterize(sph), Point=vec.Vector)  # -> Point, Normal, UDirection, VDirection, Frame
X = UnitX(Factor=Slider(4, range=0..10))
X_2 = UnitX(Factor=Slider(2, range=0..10))
X_3 = UnitX(Factor=Slider(8, range=0..10))
ln = Line(StartPoint=pt, EndPoint=evalsrf.Point)
swatch = ColourSwatch(SwatchColor=RGB(237, 5, 164))
move = Move(Geometry=sph, Motion=X)  # -> Geometry, Transform
move_2 = Move(Geometry=ln, Motion=X_2)  # -> Geometry, Transform
move_3 = Move(Geometry=sph, Motion=X_3)  # -> Geometry, Transform
c_script = CSharpScript(crv=move_2.Geometry, color=swatch)  # -> out, A; inputs crv: Curve, color: Color
# ---------- c_script: C# ----------
    var c = color.R + "," + color.G + "," + color.B;
    crv.SetUserString("attr", c);
    A = crv;
# ---------- end c_script ----------
c_script_2 = CSharpScript(crv=ln, color=swatch)  # -> out, A; inputs crv: Curve, color: Color
# ---------- c_script_2: C# ----------
    var c = color.R + "," + color.G + "," + color.B;
    crv.SetUserString("color", c);
    A = crv;
# ---------- end c_script_2 ----------

# ---- group: RH_OUT:geo
crv = Curve(c_script_2.A)

# ---- group: RH_OUT:attr
crv_2 = Curve(c_script.A)

# ---- group: RH_OUT:spheremesh
mesh = Mesh(move.Geometry)

# ---- group: RH_OUT:spherebrep
brep = Brep(move_3.Geometry)
