# Grasshopper definition volumeMassing.gh (Grasshopper 1.0.7)

minxcoord = Slider(49, range=0..100)
maxxcoord = Slider(100, range=0..100)
minycoord = Slider(28, range=0..100)
maxycoord = Slider(44, range=0..100)
minlength = Slider(30, range=20..50)
maxlength = Slider(41, range=20..50)
minwidth = Slider(20, range=20..50)
maxwidth = Slider(100, range=20..150)
minangle = Slider(43, range=0..180)
maxangle = Slider(180, range=0..180)
minheight = Slider(20, range=20..50)
mindistance = Slider(45, range=20..70)
maxdistance = Slider(77, range=20..150)
maxheight = Slider(50, range=20..50)
count = Slider(10, range=1..10)
minxcoord_2 = GetNumber(minxcoord, AtLeast=1, AtMost=1, Maximum=1.797693135e+308, Minimum=-1.797693135e+308)
maxxcoord_2 = GetNumber(maxxcoord, AtLeast=1, AtMost=1, Maximum=1.797693135e+308, Minimum=-1.797693135e+308)
minycoord_2 = GetNumber(minycoord, AtLeast=1, AtMost=1, Maximum=1.797693135e+308, Minimum=-1.797693135e+308)
maxycoord_2 = GetNumber(maxycoord, AtLeast=1, AtMost=1, Maximum=1.797693135e+308, Minimum=-1.797693135e+308)
minlength_2 = GetNumber(minlength, AtLeast=1, AtMost=1, Maximum=50, Minimum=20)
maxlength_2 = GetNumber(maxlength, AtLeast=1, AtMost=1, Maximum=50, Minimum=20)
minwidth_2 = GetNumber(minwidth, AtLeast=1, AtMost=1, Maximum=1.797693135e+308, Minimum=-1.797693135e+308)
maxwidth_2 = GetNumber(maxwidth, AtLeast=1, AtMost=1, Maximum=1.797693135e+308, Minimum=-1.797693135e+308)
minangle_2 = GetNumber(minangle, AtLeast=1, AtMost=1, Maximum=1.797693135e+308, Minimum=-1.797693135e+308)
maxangle_2 = GetNumber(maxangle, AtLeast=1, AtMost=1, Maximum=1.797693135e+308, Minimum=-1.797693135e+308)
minheight_2 = GetNumber(minheight, AtLeast=1, AtMost=1, Maximum=1.797693135e+308, Minimum=-1.797693135e+308)
maxheight_2 = GetNumber(maxheight, AtLeast=1, AtMost=1, Maximum=1.797693135e+308, Minimum=-1.797693135e+308)
mindistance_2 = GetNumber(mindistance, AtLeast=1, AtMost=1, Maximum=1.797693135e+308, Minimum=-1.797693135e+308)
maxdistance_2 = GetNumber(maxdistance, AtLeast=1, AtMost=1, Maximum=1.797693135e+308, Minimum=-1.797693135e+308)
count_2 = GetNumber(count, AtLeast=1, AtMost=1, Maximum=1.797693135e+308, Minimum=-1.797693135e+308)
dom = ConstructDomain(DomainStart=minxcoord_2, DomainEnd=maxxcoord_2)
dom_2 = ConstructDomain(DomainStart=minycoord_2, DomainEnd=maxycoord_2)
dom_3 = ConstructDomain(DomainStart=minlength_2, DomainEnd=maxlength_2)
dom_4 = ConstructDomain(DomainStart=minwidth_2, DomainEnd=maxwidth_2)
dom_5 = ConstructDomain(DomainStart=minangle_2, DomainEnd=maxangle_2)
dom_6 = ConstructDomain(DomainStart=minheight_2, DomainEnd=maxheight_2)
dom_7 = ConstructDomain(DomainStart=mindistance_2, DomainEnd=maxdistance_2)
random = Random(Range=dom, Number=count_2, Seed=2)
random_2 = Random(Range=dom_2, Number=count_2, Seed=2)
random_3 = Random(Range=dom_3, Number=count_2, Seed=2)
random_4 = Random(Range=dom_4, Number=count_2, Seed=2)
random_5 = Random(Range=dom_5, Number=count_2, Seed=2)
random_6 = Random(Range=dom_6, Number=count_2, Seed=2)
random_7 = Random(Range=dom_7, Number=count_2, Seed=2)
pt = ConstructPoint(XCoordinate=random, YCoordinate=random_2, ZCoordinate=0)
rectangle = Rectangle(Plane=pt, XSize=random_3, YSize=random_4, Radius=0)  # -> Rectangle, Length
rotate = Rotate(Geometry=rectangle.Rectangle, Angle=degrees(random_5), Plane=pt)  # -> Geometry, Transform
Z = UnitZ(Factor=random_6)
bnd = Bounds(Numbers=random_7)
moveaway = MoveAwayFrom(Geometry=rotate.Geometry, Emitter=reverse(rotate.Geometry), Distance=random_7)  # -> Geometry, Transform
remap = RemapNumbers(Value=random_7, Source=bnd, Target=Domain(0, 1))  # -> Mapped, Clipped
extr = Extrude(Base=moveaway.Geometry, Direction=Z)
runion = RegionUnion(Curves=moveaway.Geometry)
cap = CapHoles(Brep=extr)
mesh = MeshBrep(
    Brep=cap,
    Settings={GridMaxCount=0, GridMinCount=16, JaggedSeams=False, MaxEdgeLength=0, MinEdgeLength=0.0001, MinTolerance=0, Refine=True, RefineAngle=0, RelativeTolerance=0.65, SimplePlanes=True, Tolerance=0})
sunion = SolidUnion(Breps=cap)
area = Area(Geometry=runion)  # -> Area, Centroid
len = Length(Curve=runion)
gradient = Gradient(
    LowerLimit=0,
    UpperLimit=1,
    Parameter=remap.Mapped,
    stops=[0: RGB(0, 0, 139), 0.328: RGB(72, 61, 139), 0.703: RGB(123, 104, 238), 1: RGB(192, 192, 255), 1: RGB(230, 230, 250)])
volume = Volume(Geometry=sunion)  # -> Volume, Centroid
ma = MassAddition(Input=area.Area)  # -> Result, PartialResults
ma_2 = MassAddition(Input=len)  # -> Result, PartialResults
ma_3 = MassAddition(Input=volume.Volume)  # -> Result, PartialResults
demesh = DeconstructMesh(Mesh=mesh)  # -> Vertices, Faces, Colours, Normals
total_area = Panel(ma.Result)
panel = Panel("""residential
commercial
office
recreational
healthcare
educational
daycare
restaurant
hotel
industrial""")
total_perimeter = Panel(ma_2.Result)
total_volume = Panel(ma_3.Result)
conmesh = ConstructMesh(Vertices=demesh.Vertices, Faces=demesh.Faces, Colours=graft(gradient))  # -> flatten(Mesh)
concat = Concatenate(FragmentA="total area: ", FragmentB=total_area, FragmentC=" m2")
concat_2 = Concatenate(FragmentA="total volume: ", FragmentB=total_volume, FragmentC=" m3")
concat_3 = Concatenate(FragmentA="total perimeter: ", FragmentB=total_perimeter, FragmentC=" m")
c_script = CSharpScript(mesh=conmesh, color=gradient, area=concat, perimeter=concat_3, volume=concat_2)  # -> out, A; inputs mesh: Mesh, color: Color, area: String, perimeter: String, volume: String
# ---------- c_script: C# ----------
    var c = color.R + "," + color.G + "," + color.B;
    mesh.SetUserString("color", c);
    mesh.SetUserString("area", area);
    mesh.SetUserString("perimeter", perimeter);
    mesh.SetUserString("volume", volume);
    A = mesh;
# ---------- end c_script ----------

# ---- group: RH_OUT:mesh
mesh_2 = Mesh(c_script.A)
